# Grasshopper definition ExportToIFC.gh (Grasshopper 1.0.7)
# Copyright: Ondřej Janota
# plug-ins: EndPoints

# ----
# Export directory path
path_to_folder_for_ifc_export = FilePath("C:\Users\A408201\Desktop\EndPoints_1.4\IFC\")
file_name = Panel("Test")

# ----
# Define your own approach if needed. This is not part of EndPoints just helper.
# It is up to user how UDA and other data are created for feeding IFC with.
# Run script parts
exportifc = Button()
updatedatafromrhino = Button()

# ----
# Mesh settings
number_slider = Slider(0.05, range=0..10)
custom_mesh_settings = SettingsCustom(
    StitchSeams=True,
    SimplePlanes=True,
    Refine=True,
    MinCount="1",
    MaxCount="100",
    AspectRatio="0",
    MaxDistance="0.001",
    MaxAngle=20,
    MinEdge=number_slider,
    MaxEdge="10")

# ----
# Read and sort Rhino geometry
# and attributes for elements and elem. assemblies
# Keys in Rhino element user data
# According to keys different attributes
# (IFCTypes, PredefinedTypes, Facility parts)
# are look up in element user data.
# Mesh geometry
panel = Panel("IfcElementPredefinedType")
python = GhPythonScript(
    Run=updatedatafromrhino,
    AssemblyNameAttName="AssemblyName",
    AssemblyFilterAttName="AssemblyName",
    PSET_Separator="@",
    IFCElementType="IfcElementType",
    IfcPredefinedType=panel,
    IFCGroup="GroupName",
    IFCSystem="SystemName",
    FacilityPartName="IfcFacilityPart",
    FacilityPartType="IfcFacilityPartType")  # -> Geometry, Colors, IFCTypes, ElementPredefinedTypes, UDAKeys, UDAValues, PSets, Layers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
# ---------- python: Python ----------
import Rhino.Geometry as rg
import Rhino as r
import Grasshopper.DataTree as gdt
import Grasshopper as g
import Grasshopper.Kernel.Types as gkt
import Grasshopper.Kernel.Data as gkd
import System.Drawing as sd

# Get active document
doc = r.RhinoDoc.ActiveDoc
# Get layer table
layerTable = doc.Layers
# Get object table 
objectTable = doc.Objects
# Get material table
materailTable = doc.Materials


# Filter geometry. Only Brep, Surfaces, Extrusions and Meshes are imported from Rhino
def FilterGeometry(ObjRef):
    if ObjRef.ObjectType == r.DocObjects.ObjectType.Brep:
        result = True
        geometry = gkt.GH_Brep(ObjRef.Geometry)
    elif ObjRef.ObjectType == r.DocObjects.ObjectType.Surface:
        result = True
        geometry = gkt.GH_Surface(ObjRef.Geometry)
    elif ObjRef.ObjectType == r.DocObjects.ObjectType.Extrusion:
        result = True
        geometry = gkt.GH_Surface(ObjRef.Geometry)
    elif ObjRef.ObjectType == r.DocObjects.ObjectType.Mesh:
        result = True
        geometry = gkt.GH_Mesh(ObjRef.Geometry)
    else:
        result = False
        geometry = None
    return result, geometry


# Get User strings from Rhino objects. If UDA contains separator it is imported to UDAKeys and UDAValues.
# If User string is equal to IFCElementType it export IFCType 
def GetUDA(ObjRef):
    ObjIFCType = gkt.GH_String("ifcbuildingelementproxy")
    ObjUDAKeys = []
    ObjUDAValues = []
    ObjUDAPSets = []
    for x in range(len(ObjRef.Attributes.GetUserStrings())):
        if (ObjRef.Attributes.GetUserStrings().GetKey(x) == IFCElementType):
            ObjIFCType = gkt.GH_String(ObjRef.Attributes.GetUserStrings().Get(x))
        elif (PSET_Separator in ObjRef.Attributes.GetUserStrings().GetKey(x)):
            ObjUDAKeys.append(gkt.GH_String(ObjRef.Attributes.GetUserStrings().GetKey(x).Split(PSET_Separator)[1]))
            ObjUDAPSets.append(gkt.GH_String(ObjRef.Attributes.GetUserStrings().GetKey(x).Split(PSET_Separator)[0]))
            ObjUDAValues.append(gkt.GH_String(ObjRef.Attributes.GetUserStrings().Get(x)))
    return ObjIFCType, ObjUDAPSets, ObjUDAKeys, ObjUDAValues

# Get element name
def GetName(ObjRef):
    name = ObjRef.Attributes.Name
    if (name is None):
        name = "Value_not_defined"
    return name

# Check if element is part of assembly
def PartOfAssembly(ObjRef):
    if (ObjRef.Attributes.GetUserStrings()[AssemblyFilterAttName] != None):
        return True, 
    else:
        return False

# Check if element is part of group
def PartOfGroup(ObjRef):
    if (ObjRef.Attributes.GetUserStrings()[IFCGroup] != None):
        return ObjRef.Attributes.GetUserStrings()[IFCGroup]
    else:
        return None
        
# Check if element is part of group
def PartOfSystem(ObjRef):
    if (ObjRef.Attributes.GetUserStrings()[IFCSystem] != None):
        return ObjRef.Attributes.GetUserStrings()[IFCSystem]
    else:
        return None
        
# Get assembly name
def DefineAssemlby(ObjRef):
    if (ObjRef.Attributes.GetUserStrings()[AssemblyFilterAttName] != None):
        return ObjRef.Attributes.GetUserStrings()[AssemblyNameAttName]
    else:
        return None
        
# Get facility part name
def GetFacilityPartName(ObjRef):
    if (ObjRef.Attributes.GetUserStrings()[FacilityPartName] != None):
        return ObjRef.Attributes.GetUserStrings()[FacilityPartName]
    else:
        return None
        
# Get facility part type name
def GetFacilityPartType(ObjRef):
    if (ObjRef.Attributes.GetUserStrings()[FacilityPartType] != None):
        return ObjRef.Attributes.GetUserStrings()[FacilityPartType]
    else:
        return None
        
# Get element predefined type
def GetElementPredefinedType(ObjRef):
    if (ObjRef.Attributes.GetUserStrings()[IfcPredefinedType] != None):
        return ObjRef.Attributes.GetUserStrings()[IfcPredefinedType]
    else:
        return None

# Add element to assemblydictionary
def CheckKey(dic, key, value):
    if key in dic.keys():
        dic[key].append(value)
    else:
        dic[key] = [value]

# Get material name
def GetMaterial(ObjRef):
    if (ObjRef.Attributes.MaterialSource == r.DocObjects.ObjectMaterialSource.MaterialFromLayer):
        if (layerTable.FindIndex(ObjRef.Attributes.LayerIndex).RenderMaterialIndex != -1):
            return materailTable[layerTable.FindIndex(ObjRef.Attributes.LayerIndex).RenderMaterialIndex].Name
    elif(ObjRef.Attributes.MaterialSource == r.DocObjects.ObjectMaterialSource.MaterialFromObject):
        if (ObjRef.Attributes.MaterialIndex != -1):
            return materailTable[ObjRef.Attributes.MaterialIndex].Name
    return None

if (Run):
    ghenv.Component.ExpireSolution(True)

# Output data trees - elements which are not part of assembly
FacilityParts = g.DataTree[gkt.GH_String]()
Colors = g.DataTree[gkt.GH_Colour]()
Layers = g.DataTree[gkt.GH_String]()
UDAKeys = g.DataTree[gkt.GH_String]()
UDAValues = g.DataTree[gkt.GH_String]()
PSets = g.DataTree[gkt.GH_String]()
IFCTypes = g.DataTree[gkt.GH_String]()
Geometry = g.DataTree[gkt.IGH_GeometricGoo]()
Names = g.DataTree[gkt.GH_String]()
Groups = g.DataTree[gkt.GH_String]()
Systems = g.DataTree[gkt.GH_String]()
Materials = g.DataTree[gkt.GH_String]()
FacilityPartNames = g.DataTree[gkt.GH_String]()
FacilityPartPredefinedTypes = g.DataTree[gkt.GH_String]()
ElementPredefinedTypes = g.DataTree[gkt.GH_String]()
# Output data trees - elements which are part of assembly
FacilityPartsAss = g.DataTree[gkt.GH_String]()
NameAss = g.DataTree[gkt.GH_String]()
ColorsAss = g.DataTree[gkt.GH_Colour]()
LayersAss = g.DataTree[gkt.GH_String]()
UDAKeysAss = g.DataTree[gkt.GH_String]()
UDAValuesAss = g.DataTree[gkt.GH_String]()
PSetsAss = g.DataTree[gkt.GH_String]()
IFCTypesAss = g.DataTree[gkt.GH_String]()
GeometryAss = g.DataTree[gkt.IGH_GeometricGoo]()
NamesAss = g.DataTree[gkt.GH_String]()
GroupsAss = g.DataTree[gkt.GH_String]()
SystemsAss = g.DataTree[gkt.GH_String]()
MaterialsAss = g.DataTree[gkt.GH_String]()
FacilityPartNamesAss = g.DataTree[gkt.GH_String]()
FacilityPartPredefinedTypesAss = g.DataTree[gkt.GH_String]()
ElementPredefinedTypesAss = g.DataTree[gkt.GH_String]()

# Dictionary for elementassemblies
assemblyDictionary = {}

# Iterate over layers and filter assembly and not assembly elements. 
# Fill output trees for not assembly elements
for i in range(len(layerTable)):
    layer = layerTable[i]
    if (layer.IsVisible):
        path = gkd.GH_Path(i)
        # Get Rhino objects by layer
        ObjReferences = doc.Objects.FindByLayer(layer)
        if len(ObjReferences) > 0:
            # Iterate over all Rhino objects
            z = 0;
            for x in range(len(ObjReferences)):
                if (ObjReferences[x] is not None and ObjReferences[x].Visible):
                    pathUDA = gkd.GH_Path(i,z)
                    # Get color and layer of from layer
                    color = gkt.GH_Colour(sd.Color.FromArgb(0,layer.Color.R,layer.Color.G,layer.Color.B))
                    name = gkt.GH_String(GetName(ObjReferences[x]))
                    layerName = gkt.GH_String(layer.Name)
                    result, geometry = FilterGeometry(ObjReferences[x])
                    group = PartOfGroup(ObjReferences[x])
                    system = PartOfSystem(ObjReferences[x])
                    material = GetMaterial(ObjReferences[x])
                    facilityPartName = GetFacilityPartName(ObjReferences[x])
                    facilityPartType = GetFacilityPartType(ObjReferences[x])
                    elementPredefinedType = GetElementPredefinedType(ObjReferences[x])
                    # Fill output trees for elements which are not part of assembly.
                    if (not PartOfAssembly(ObjReferences[x])):
                        if (result):
                            if (group != None):
                                Groups.Add(gkt.GH_String(group), path)
                            if (system != None):
                                Systems.Add(gkt.GH_String(system), path)
                            if (material != None):
                                Materials.Add(gkt.GH_String(material), path)
                            if (facilityPartName != None):
                                FacilityPartNames.Add(gkt.GH_String(facilityPartName), path)
                            if (facilityPartType != None):
                                FacilityPartPredefinedTypes.Add(gkt.GH_String(facilityPartType), path)
                            if (elementPredefinedType != None):
                                ElementPredefinedTypes.Add(gkt.GH_String(elementPredefinedType), path)
                            Colors.Add(color,path)
                            Names.Add(name, path)
                            Layers.Add(layerName,path)
                            FacilityParts.Add(layerName,path)
                            Geometry.Add(geometry,path)
                            objIFCType, objUDAPSets, objUDAKeys, objUDAValues = GetUDA(ObjReferences[x])
                            IFCTypes.Add(objIFCType, path)
                            PSets.AddRange(objUDAPSets, pathUDA)
                            UDAKeys.AddRange(objUDAKeys, pathUDA)
                            UDAValues.AddRange(objUDAValues, pathUDA)
                            
                            z+=1
                    # Fill output trees for elements which are parts of element assembly.
                    else:
                        if (result):
                            assemblyName = DefineAssemlby(ObjReferences[x])
                            if (assemblyName is not None):
                                CheckKey(assemblyDictionary, assemblyName,ObjReferences[x])
                            
                            

# Iterate over assembly elements dictionary and fill output trees for assemblies
# Only layer of first item is used. (Assemblies should be in a separte layer) 
# dtto building stories and properties (user must develop own workflow to fit their needs)
i = 0
for assembly in assemblyDictionary.items():
    path = gkd.GH_Path(i)
    for x in range(len(assembly[1])):
        ObjReference = assembly[1][x]
        layer = layerTable.FindIndex(ObjReference.Attributes.LayerIndex)
        objIFCType, objUDAPSets, objUDAKeys, objUDAValues = GetUDA(ObjReference)
        name = gkt.GH_String(GetName(ObjReference))
        group = PartOfGroup(ObjReference)
        system = PartOfSystem(ObjReference)
        material = GetMaterial(ObjReference)
        facilityPartName = GetFacilityPartName(ObjReference)
        facilityPartType = GetFacilityPartType(ObjReference)
        elementPredefinedType = GetElementPredefinedType(ObjReference)
        if (group != None):
            GroupsAss.Add(gkt.GH_String(group), path)
        if (system != None):
            SystemsAss.Add(gkt.GH_String(system), path)
        if (material != None):
            MaterialsAss.Add(gkt.GH_String(material), path)
        if (elementPredefinedType != None):
            ElementPredefinedTypesAss.Add(gkt.GH_String(elementPredefinedType), path)
        if x == 0:
            if (facilityPartName != None):
                FacilityPartNamesAss.Add(gkt.GH_String(facilityPartName), path)
            if (facilityPartType != None):
                FacilityPartPredefinedTypesAss.Add(gkt.GH_String(facilityPartType), path)
            # Add layer
            LayersAss.Add(gkt.GH_String(layer.Name), path)
            # Add buildingStoreis
            PSetsAss.AddRange(objUDAPSets, path)
            UDAKeysAss.AddRange(objUDAKeys, path)
            UDAValuesAss.AddRange(objUDAValues, path)
            NameAss.Add(gkt.GH_String(assembly[0]), path)
        # Add IFCType 
        IFCTypesAss.Add(objIFCType, path)
        # Add color
        ColorsAss.Add(gkt.GH_Colour(sd.Color.FromArgb(0,layer.Color.R,layer.Color.G,layer.Color.B)), path)
        # Add name
        NamesAss.Add(name, path)
        # Add geometry
        result, geometry = FilterGeometry(ObjReference)
        GeometryAss.Add(geometry,path)
    i+=1
# ---------- end python ----------
mesh_elements = MeshBrep(Brep=python.Geometry, Settings=custom_mesh_settings)
mesh_elements_2 = MeshBrep(Brep=python.GeometryAss, Settings=custom_mesh_settings)

# ----
# Project nad facility name
# IFC version and facility type
ifcfacilitytypes = IFCFacilityTypes({"Building", "Bridge", "Marine", "Road", "Railway", "Common"}, selected="Building")
facility_name = Panel("EndPoints")
ifcschema = IFCSchema({"IFC 2x3", "IFC 4", "IFC 4.3"}, selected="IFC 4")
project_name = Panel("Test")

# ----
# Coordinates shift
x_y_z_coordinate_shift = Panel("""-79600
-980200
0""")
item = ListItem(List=x_y_z_coordinate_shift, Index=0, Wrap=True)  # -> Item, Item1, Item2

# ----
# Define CRS (only for IFC 4.3)
panel_2 = Panel("S-JTSK")
ifccoorinaterefenrecesystem = IFCCRS(CRSName=panel_2, CRSDescription="S-JTSK, EPSG 5514", CRSGeodeticDatum="5514")

# ----
# IFCElementAssemblies
ifcelementassembly = IFCElementAssembly(
    FacilityType=ifcfacilitytypes,
    FacilityPartName=python.FacilityPartNamesAss,
    FacilityPartType=python.FacilityPartPredefinedTypesAss_2,
    ElementAssemblyName=python.NameAss,
    GeometryElements=mesh_elements_2,
    Colours=python.ColorsAss,
    ElementNames=python.NamesAss,
    ElementMaterial=python.MaterialsAss,
    IFCElementTypes=python.IFCTypesAss,
    IFCElementsPredefinedTypes=python.ElementPredefinedTypesAss,
    UDAKeys=python.UDAKeysAss,
    UDAValues=python.UDAValuesAss,
    UDAPropertySets=python.PSetsAss,
    IFCGroups=python.GroupsAss,
    IFCSystems=python.SystemsAss,
    IFCLayers=python.LayersAss)

# ----
# Export to IFC
ifcexport = IFCExport(
    Export=exportifc,
    FileName=file_name,
    Directory=path_to_folder_for_ifc_export,
    IFCSchema=ifcschema,
    CoordinateReferenceSystem=ifccoorinaterefenrecesystem,
    ProjectName=ifcfacilitytypes,
    FacilityType=ifcfacilitytypes,
    FacilitySubType=project_name,
    FacilityName=facility_name,
    FacilityPartsNames=python.FacilityPartNames,
    FacilityPartsTypes=python.FacilityPartPredefinedTypesAss,
    GeometryElements=mesh_elements,
    ElementAssemblyElements=ifcelementassembly,
    ElementNames=python.Names,
    ElementMaterial=python.Materials,
    Colours=python.Colors,
    IFCElementTypes=python.IFCTypes,
    IFCElementsPredefinedTypes=python.ElementPredefinedTypes,
    UDAKeys=python.UDAKeys,
    UDAValues=python.UDAValues,
    UDAPropertySets=python.PSets,
    IFCLayers=python.Layers,
    IFCGroups=python.Groups,
    IFCSystems=python.Systems,
    XCoordinate=item.Item,
    YCoordinate=item.Item1,
    ZCoordinate=0,
    Rotation=item.Item2)
