# Grasshopper definition SampleFileIFC.gh (Grasshopper 1.0.7)
# plug-ins: EndPoints

# ----
# Filter geometry and attributes for
# elements.
panel = Panel("AssemblyName")
python = GhPythonScript(AssemblyNameAttName=panel, AssemblyFilterAttName="Assembly", PSET_Separator="_", IFCTypeUDA="IFCType")  # -> BuildingStories, Geometry, Colors, IFCTypes, UDAKeys, UDAValues, PSets, Layers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
# ---------- python: Python ----------
import Rhino.Geometry as rg
import Rhino as r
import Grasshopper.DataTree as gdt
import Grasshopper as g
import Grasshopper.Kernel.Types as gkt
import Grasshopper.Kernel.Data as gkd
import System.Drawing as sd



# Filter geometry. Only Brep, Surfaces, Extrusions and Meshes are imported from Rhino
def FilterGeometry(ObjRef):
    if ObjRef.ObjectType == r.DocObjects.ObjectType.Brep:
        result = True
        geometry = gkt.GH_Brep(ObjRef.Geometry)
    elif ObjRef.ObjectType == r.DocObjects.ObjectType.Surface:
        result = True
        geometry = gkt.GH_Surface(ObjRef.Geometry)
    elif ObjRef.ObjectType == r.DocObjects.ObjectType.Extrusion:
        result = True
        geometry = gkt.GH_Surface(ObjRef.Geometry)
    elif ObjRef.ObjectType == r.DocObjects.ObjectType.Mesh:
        result = True
        geometry = gkt.GH_Mesh(ObjRef.Geometry)
    return result, geometry

# Get User strings from Rhino objects. If UDA contains separator it is imported to UDAKeys and UDAValues.
# If User string is equal to IFCTypeUDA it export IFCType 
def GetUDA(ObjRef):
    ObjIFCType = gkt.GH_String("ifcbuildingelementproxy")
    ObjUDAKeys = []
    ObjUDAValues = []
    ObjUDAPSets = []
    for x in range(len(ObjRef.Attributes.GetUserStrings())):
        if (ObjRef.Attributes.GetUserStrings().GetKey(x) == IFCTypeUDA):
            ObjIFCType = gkt.GH_String(ObjRef.Attributes.GetUserStrings().Get(x))
        elif (PSET_Separator in ObjRef.Attributes.GetUserStrings().GetKey(x)):
            ObjUDAKeys.append(gkt.GH_String(ObjRef.Attributes.GetUserStrings().GetKey(x).Split(PSET_Separator)[1]))
            ObjUDAPSets.append(gkt.GH_String(ObjRef.Attributes.GetUserStrings().GetKey(x).Split(PSET_Separator)[0]))
            ObjUDAValues.append(gkt.GH_String(ObjRef.Attributes.GetUserStrings().Get(x)))
    return ObjIFCType, ObjUDAPSets, ObjUDAKeys, ObjUDAValues
    
# Check  if element is part of assembly
def PartOfAssembly(ObjRef):
    if (ObjRef.Attributes.GetUserStrings()[AssemblyFilterAttName] == "Yes"):
        return True
    else:
        return False
        
# Check get assembly name
def DefineAssemlby(ObjRef):
    if (ObjRef.Attributes.GetUserStrings()[AssemblyFilterAttName] == "Yes"):
        return ObjRef.Attributes.GetUserStrings()[AssemblyNameAttName]
    else:
        return None

# Add element to assemblydictionary
def CheckKey(dic, key, value):
    if key in dic.keys():
        dic[key].append(value)
    else:
        dic[key] = [value]


# Output data trees - elements which are not part of assembly
BuildingStories = g.DataTree[gkt.GH_String]()
Colors = g.DataTree[gkt.GH_Colour]()
Layers = g.DataTree[gkt.GH_String]()
UDAKeys = g.DataTree[gkt.GH_String]()
UDAValues = g.DataTree[gkt.GH_String]()
PSets = g.DataTree[gkt.GH_String]()
IFCTypes = g.DataTree[gkt.GH_String]()
Geometry = g.DataTree[gkt.IGH_GeometricGoo]()

# Output data trees - elements which are part of assembly
BuildingStoriesAss = g.DataTree[gkt.GH_String]()
ColorsAss = g.DataTree[gkt.GH_Colour]()
LayersAss = g.DataTree[gkt.GH_String]()
UDAKeysAss = g.DataTree[gkt.GH_String]()
UDAValuesAss = g.DataTree[gkt.GH_String]()
PSetsAss = g.DataTree[gkt.GH_String]()
IFCTypesAss = g.DataTree[gkt.GH_String]()
GeometryAss = g.DataTree[gkt.IGH_GeometricGoo]()



# Get active document
doc = r.RhinoDoc.ActiveDoc
# Get layer table
layerTable = doc.Layers
# Get object table 
objectTable = doc.Objects

# Dictionary for elementassemblies
assemblyDictionary = {}

# Iterate over layers and filter assembly and not assembly elements. 
# Fill output trees for not assembly elements
for i in range(len(layerTable)):
    layer = layerTable[i]
    if (layer.IsVisible):
        path = gkd.GH_Path(i)
        # Get Rhino objects by layer
        ObjReferences = doc.Objects.FindByLayer(layer)
        if len(ObjReferences) > 0:
            # Iterate over all Rhino objects
            for x in range(len(ObjReferences)):
                if (ObjReferences[x] is not None and ObjReferences[x].Visible):
                    pathUDA = gkd.GH_Path(i,x)
                    # Get color and layer of from layer
                    color = gkt.GH_Colour(sd.Color.FromArgb(0,layer.Color.R,layer.Color.G,layer.Color.B))
                    layerName = gkt.GH_String(layer.Name)
                    result, geometry = FilterGeometry(ObjReferences[x])
                    # Fill output trees for elements which are not part of assembly.
                    if (not PartOfAssembly(ObjReferences[x])):
                        if (result):
                            Colors.Add(color,path)
                            Layers.Add(layerName,path)
                            BuildingStories.Add(layerName,path)
                            Geometry.Add(geometry,path)
                            objIFCType, objUDAPSets, objUDAKeys, objUDAValues = GetUDA(ObjReferences[x])
                            IFCTypes.Add(objIFCType, path)
                            PSets.AddRange(objUDAPSets, pathUDA)
                            UDAKeys.AddRange(objUDAKeys, pathUDA)
                            UDAValues.AddRange(objUDAValues, pathUDA)
                    # Fill output trees for elements which are parts of element assembly.
                    else:
                        if (result):
                            assemblyName = DefineAssemlby(ObjReferences[x])
                            if (assemblyName is not None):
                                CheckKey(assemblyDictionary, assemblyName,ObjReferences[x])
                            
                            

# Iterate over assembly elements dictionary and fill output trees for assemblies
# Only layer of first item is used. (Assemblies should be in a separte layer) 
# dtto building stories and properties (user must develop own workflow to fit their needs)
i = 0
for assembly in assemblyDictionary.items():
    path = gkd.GH_Path(i)
    for x in range(len(assembly[1])):
        ObjReference = assembly[1][x]
        layer = layerTable.FindIndex(ObjReference.Attributes.LayerIndex)
        objIFCType, objUDAPSets, objUDAKeys, objUDAValues = GetUDA(ObjReference)
        if x == 0:
            # Add layer
            LayersAss.Add(gkt.GH_String(layer.Name), path)
            # Add buildingStoreis
            BuildingStoriesAss.Add(gkt.GH_String(layer.Name), path)
            PSetsAss.AddRange(objUDAPSets, path)
            UDAKeysAss.AddRange(objUDAKeys, path)
            UDAValuesAss.AddRange(objUDAValues, path)
        # Add IFCType 
        IFCTypesAss.Add(objIFCType, path)
        # Add color
        ColorsAss.Add(gkt.GH_Colour(sd.Color.FromArgb(0,layer.Color.R,layer.Color.G,layer.Color.B)), path)
        # Add geometry
        result, geometry = FilterGeometry(ObjReference)
        GeometryAss.Add(geometry,path)
    i+=1
# ---------- end python ----------

# ----
# File name, IFC schema
# Hit and run button!
panel_2 = Panel("BuildingName")
ifcschema = IFCSchema({"IFC 2x3", "IFC 4"}, selected="IFC 4")
# EndPoints - IFC Export with IfcElementrAssembly
button = Button()
path = FilePath("C:\Users\Janot\Desktop\Sample1\")

# ----
# Mesh geometry.
# You can play with the topology!
mesh = MeshBrep(
    Brep=python.Geometry,
    Settings={GridMaxCount=0, GridMinCount=16, JaggedSeams=False, MaxEdgeLength=0, MinEdgeLength=0.0001, MinTolerance=0, Refine=True, RefineAngle=0, RelativeTolerance=0.65, SimplePlanes=True, Tolerance=0})
mesh_2 = MeshBrep(
    Brep=python.GeometryAss,
    Settings={GridMaxCount=0, GridMinCount=16, JaggedSeams=False, MaxEdgeLength=0, MinEdgeLength=0.0001, MinTolerance=0, Refine=True, RefineAngle=0, RelativeTolerance=0.65, SimplePlanes=True, Tolerance=0})

# ----
# Craete ElementAssemblies
ifcelementassembly = IFCElementAssembly(
    BuildingStoreyNames=python.BuildingStoriesAss,
    GeometryElements=mesh_2,
    Colours=python.ColorsAss,
    IFCElementTypes=python.IFCTypesAss,
    UDAKeys=python.UDAKeysAss,
    UDAValues=python.UDAValuesAss,
    UDAPropertySets=python.PSetsAss,
    IFCLayers=python.LayersAss)

# ----
# IFC Export
ifcexport = IFCExport(
    Export=button,
    FileName="SampleFileIFC",
    Directory=path,
    IFCSchema=ifcschema,
    ProjectName="ProjectName",
    BuildingName=panel_2,
    BuildingStoreyNames=python.BuildingStories,
    GeometryElements=mesh,
    ElementAssemblyElements=ifcelementassembly,
    Colours=python.Colors,
    IFCElementTypes=python.IFCTypes,
    UDAKeys=python.UDAKeys,
    UDAValues=python.UDAValues,
    UDAPropertySets=python.PSets,
    IFCLayers=python.Layers)
