# Grasshopper definition SampleFileIFC_1.3.0.gh (Grasshopper 1.0.7)
# plug-ins: EndPoints

# ----
# Filter geometry and attributes for
# elements.
panel = Panel("AssemblyName")
python = GhPythonScript(AssemblyNameAttName=panel, AssemblyFilterAttName="Assembly", PSET_Separator="_", IFCTypeUDA="IFCType")  # -> Geometry, Colors, IFCTypes, UDAKeys, UDAValues, PSets, Layers, Names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
# ---------- python: Python ----------
import Rhino.Geometry as rg
import Rhino as r
import Grasshopper.DataTree as gdt
import Grasshopper as g
import Grasshopper.Kernel.Types as gkt
import Grasshopper.Kernel.Data as gkd
import System.Drawing as sd



# Filter geometry. Only Brep, Surfaces, Extrusions and Meshes are imported from Rhino
def FilterGeometry(ObjRef):
    if ObjRef.ObjectType == r.DocObjects.ObjectType.Brep:
        result = True
        geometry = gkt.GH_Brep(ObjRef.Geometry)
    elif ObjRef.ObjectType == r.DocObjects.ObjectType.Surface:
        result = True
        geometry = gkt.GH_Surface(ObjRef.Geometry)
    elif ObjRef.ObjectType == r.DocObjects.ObjectType.Extrusion:
        result = True
        geometry = gkt.GH_Surface(ObjRef.Geometry)
    elif ObjRef.ObjectType == r.DocObjects.ObjectType.Mesh:
        result = True
        geometry = gkt.GH_Mesh(ObjRef.Geometry)
    return result, geometry

# Get User strings from Rhino objects. If UDA contains separator it is imported to UDAKeys and UDAValues.
# If User string is equal to IFCTypeUDA it export IFCType 
def GetUDA(ObjRef):
    ObjIFCType = gkt.GH_String("ifcbuildingelementproxy")
    ObjUDAKeys = []
    ObjUDAValues = []
    ObjUDAPSets = []
    for x in range(len(ObjRef.Attributes.GetUserStrings())):
        if (ObjRef.Attributes.GetUserStrings().GetKey(x) == IFCTypeUDA):
            ObjIFCType = gkt.GH_String(ObjRef.Attributes.GetUserStrings().Get(x))
        elif (PSET_Separator in ObjRef.Attributes.GetUserStrings().GetKey(x)):
            ObjUDAKeys.append(gkt.GH_String(ObjRef.Attributes.GetUserStrings().GetKey(x).Split(PSET_Separator)[1]))
            ObjUDAPSets.append(gkt.GH_String(ObjRef.Attributes.GetUserStrings().GetKey(x).Split(PSET_Separator)[0]))
            ObjUDAValues.append(gkt.GH_String(ObjRef.Attributes.GetUserStrings().Get(x)))
    return ObjIFCType, ObjUDAPSets, ObjUDAKeys, ObjUDAValues
    
def GetName(ObjRef):
    name = ObjRef.Attributes.Name
    if (name is None):
        name = "Value_not_defined"
    return name

# Check  if element is part of assembly
def PartOfAssembly(ObjRef):
    if (ObjRef.Attributes.GetUserStrings()[AssemblyFilterAttName] == "Yes"):
        return True
    else:
        return False
        
# Check get assembly name
def DefineAssemlby(ObjRef):
    if (ObjRef.Attributes.GetUserStrings()[AssemblyFilterAttName] == "Yes"):
        return ObjRef.Attributes.GetUserStrings()[AssemblyNameAttName]
    else:
        return None

# Add element to assemblydictionary
def CheckKey(dic, key, value):
    if key in dic.keys():
        dic[key].append(value)
    else:
        dic[key] = [value]


# Output data trees - elements which are not part of assembly
FacilityParts = g.DataTree[gkt.GH_String]()
Colors = g.DataTree[gkt.GH_Colour]()
Layers = g.DataTree[gkt.GH_String]()
UDAKeys = g.DataTree[gkt.GH_String]()
UDAValues = g.DataTree[gkt.GH_String]()
PSets = g.DataTree[gkt.GH_String]()
IFCTypes = g.DataTree[gkt.GH_String]()
Geometry = g.DataTree[gkt.IGH_GeometricGoo]()
Names = g.DataTree[gkt.GH_String]()

# Output data trees - elements which are part of assembly
FacilityPartsAss = g.DataTree[gkt.GH_String]()
ColorsAss = g.DataTree[gkt.GH_Colour]()
LayersAss = g.DataTree[gkt.GH_String]()
UDAKeysAss = g.DataTree[gkt.GH_String]()
UDAValuesAss = g.DataTree[gkt.GH_String]()
PSetsAss = g.DataTree[gkt.GH_String]()
IFCTypesAss = g.DataTree[gkt.GH_String]()
GeometryAss = g.DataTree[gkt.IGH_GeometricGoo]()
NamesAss = g.DataTree[gkt.GH_String]()


# Get active document
doc = r.RhinoDoc.ActiveDoc
# Get layer table
layerTable = doc.Layers
# Get object table 
objectTable = doc.Objects

# Dictionary for elementassemblies
assemblyDictionary = {}

# Iterate over layers and filter assembly and not assembly elements. 
# Fill output trees for not assembly elements
for i in range(len(layerTable)):
    layer = layerTable[i]
    if (layer.IsVisible):
        path = gkd.GH_Path(i)
        # Get Rhino objects by layer
        ObjReferences = doc.Objects.FindByLayer(layer)
        if len(ObjReferences) > 0:
            # Iterate over all Rhino objects
            z = 0;
            for x in range(len(ObjReferences)):
                if (ObjReferences[x] is not None and ObjReferences[x].Visible):
                    pathUDA = gkd.GH_Path(i,z)
                    # Get color and layer of from layer
                    color = gkt.GH_Colour(sd.Color.FromArgb(0,layer.Color.R,layer.Color.G,layer.Color.B))
                    name = gkt.GH_String(GetName(ObjReferences[x]))
                    layerName = gkt.GH_String(layer.Name)
                    result, geometry = FilterGeometry(ObjReferences[x])
                    # Fill output trees for elements which are not part of assembly.
                    if (not PartOfAssembly(ObjReferences[x])):
                        if (result):
                            Colors.Add(color,path)
                            Names.Add(name, path)
                            Layers.Add(layerName,path)
                            FacilityParts.Add(layerName,path)
                            Geometry.Add(geometry,path)
                            objIFCType, objUDAPSets, objUDAKeys, objUDAValues = GetUDA(ObjReferences[x])
                            IFCTypes.Add(objIFCType, path)
                            PSets.AddRange(objUDAPSets, pathUDA)
                            UDAKeys.AddRange(objUDAKeys, pathUDA)
                            UDAValues.AddRange(objUDAValues, pathUDA)
                            z+=1
                    # Fill output trees for elements which are parts of element assembly.
                    else:
                        if (result):
                            assemblyName = DefineAssemlby(ObjReferences[x])
                            if (assemblyName is not None):
                                CheckKey(assemblyDictionary, assemblyName,ObjReferences[x])
                            
                            

# Iterate over assembly elements dictionary and fill output trees for assemblies
# Only layer of first item is used. (Assemblies should be in a separte layer) 
# dtto building stories and properties (user must develop own workflow to fit their needs)
i = 0
for assembly in assemblyDictionary.items():
    path = gkd.GH_Path(i)
    for x in range(len(assembly[1])):
        ObjReference = assembly[1][x]
        layer = layerTable.FindIndex(ObjReference.Attributes.LayerIndex)
        objIFCType, objUDAPSets, objUDAKeys, objUDAValues = GetUDA(ObjReference)
        name = gkt.GH_String(GetName(ObjReference))
        if x == 0:
            # Add layer
            LayersAss.Add(gkt.GH_String(layer.Name), path)
            # Add buildingStoreis
            FacilityPartsAss.Add(gkt.GH_String(layer.Name), path)
            PSetsAss.AddRange(objUDAPSets, path)
            UDAKeysAss.AddRange(objUDAKeys, path)
            UDAValuesAss.AddRange(objUDAValues, path)
        # Add IFCType 
        IFCTypesAss.Add(objIFCType, path)
        # Add color
        ColorsAss.Add(gkt.GH_Colour(sd.Color.FromArgb(0,layer.Color.R,layer.Color.G,layer.Color.B)), path)
        # Add name
        NamesAss.Add(name, path)
        # Add geometry
        result, geometry = FilterGeometry(ObjReference)
        GeometryAss.Add(geometry,path)
    i+=1
# ---------- end python ----------

# ----
# Hit and run button!
button = Button()

# ----
# File name, IFC schema
filename = Panel("SampleIFC")
path = FilePath("C:\Users\Janot\Desktop\EndPoints\SampleFiles\1.3.0\")
ifcschema = IFCSchema({"IFC 2x3", "IFC 4", "IFC 4.3"}, selected="IFC 4.3")
ifcschema_2 = IFCSchema({"IFC 2x3", "IFC 4", "IFC 4.3"}, selected="IFC 4")
ifcschema_3 = IFCSchema({"IFC 2x3", "IFC 4", "IFC 4.3"}, selected="IFC 2x3")

# ----
# Mesh geometry.
# You can play with the topology!
mesh_elements = MeshBrep(
    Brep=python.Geometry,
    Settings={GridMaxCount=0, GridMinCount=16, JaggedSeams=False, MaxEdgeLength=0, MinEdgeLength=0.0001, MinTolerance=0, Refine=True, RefineAngle=0, RelativeTolerance=0.65, SimplePlanes=True, Tolerance=0})
mesh = MeshBrep(
    Brep=python.GeometryAss,
    Settings={GridMaxCount=0, GridMinCount=16, JaggedSeams=False, MaxEdgeLength=0, MinEdgeLength=0.0001, MinTolerance=0, Refine=True, RefineAngle=0, RelativeTolerance=0.65, SimplePlanes=True, Tolerance=0})

# ----
# FacilityPartNames
panel_2 = Panel("""Storey 01
Storey 02
Storey 03
Storey 04
Storey 05""")
lng = ListLength(List=python.Geometry)
dup = DuplicateData(Data=graft(panel_2), Number=lng, Order=True)  # -> simplify(Data)

# ----
# FacilityPartNamesAssemblies
panel_3 = Panel("""Storey 03
Storey 01
Storey 06""")
lng_2 = ListLength(List=python.GeometryAss)
dup_2 = DuplicateData(Data=graft(panel_3), Number=lng_2, Order=True)  # -> simplify(Data)

# ----
# FacilityPartNamesAssemblies
lng_3 = ListLength(List=mesh)
panel_4 = Panel("""Part 4
Part 5
Part 6""")
dup_3 = DuplicateData(Data=graft(panel_4), Number=lng_3, Order=True)  # -> simplify(Data)

# ----
# FacilityPartTypesAssemblies
ifcmarineparts = IFCMarineParts({"Above water line", "Anchorage", "Approach channel", "Below water line", "Berthing structure", "Chamber", "Cill level", "Cope level", "Core", "Crest", "Gatehead", "Guding structure", "High water line", "Landfield", "Leeward side", "Low water line", "Manufacturing", "Navigational area", "Protection", "Ship transfer", "Storage area", "Vehicle servicing", "Waterfield", "Weather side", "Not defined"}, selected="Waterfield")
ifcmarineparts_2 = IFCMarineParts({"Above water line", "Anchorage", "Approach channel", "Below water line", "Berthing structure", "Chamber", "Cill level", "Cope level", "Core", "Crest", "Gatehead", "Guding structure", "High water line", "Landfield", "Leeward side", "Low water line", "Manufacturing", "Navigational area", "Protection", "Ship transfer", "Storage area", "Vehicle servicing", "Waterfield", "Weather side", "Not defined"}, selected="Gatehead")
ifcmarineparts_3 = IFCMarineParts({"Above water line", "Anchorage", "Approach channel", "Below water line", "Berthing structure", "Chamber", "Cill level", "Cope level", "Core", "Crest", "Gatehead", "Guding structure", "High water line", "Landfield", "Leeward side", "Low water line", "Manufacturing", "Navigational area", "Protection", "Ship transfer", "Storage area", "Vehicle servicing", "Waterfield", "Weather side", "Not defined"}, selected="Vehicle servicing")
merge = Merge(Data1=ifcmarineparts, Data2=ifcmarineparts_2, Data3=ifcmarineparts_3)
dup_4 = DuplicateData(Data=graft(merge), Number=lng_3, Order=True)  # -> simplify(Data)

# ----
# FacilityPartNamesAssemblies
lng_4 = ListLength(List=mesh)
panel_5 = Panel("""Part 4
Part 5
Part 6""")
dup_5 = DuplicateData(Data=graft(panel_5), Number=lng_4, Order=True)  # -> simplify(Data)

# ----
# FacilityPartTypesAssemblies
ifcroadparts = IFCRoadParts({"Bicycle crossing", "Bus stop", "Carriageway", "Central island", "Central reserve", "Hard shoudler", "Intersection", "Layby", "Parking bay", "Passing bay", "Pedestrian crossing", "Railway crossing", "Refuge island", "Road segment", "Road side", "Road side part", "Roadway plateau", "Roundabout", "Shoulder", "Sidewalk", "Soft shoulder", "Toll plaza", "Trafic island", "Traffic lane", "Not defined"}, selected="Layby")
ifcroadparts_2 = IFCRoadParts({"Bicycle crossing", "Bus stop", "Carriageway", "Central island", "Central reserve", "Hard shoudler", "Intersection", "Layby", "Parking bay", "Passing bay", "Pedestrian crossing", "Railway crossing", "Refuge island", "Road segment", "Road side", "Road side part", "Roadway plateau", "Roundabout", "Shoulder", "Sidewalk", "Soft shoulder", "Toll plaza", "Trafic island", "Traffic lane", "Not defined"}, selected="Carriageway")
ifcroadparts_3 = IFCRoadParts({"Bicycle crossing", "Bus stop", "Carriageway", "Central island", "Central reserve", "Hard shoudler", "Intersection", "Layby", "Parking bay", "Passing bay", "Pedestrian crossing", "Railway crossing", "Refuge island", "Road segment", "Road side", "Road side part", "Roadway plateau", "Roundabout", "Shoulder", "Sidewalk", "Soft shoulder", "Toll plaza", "Trafic island", "Traffic lane", "Not defined"}, selected="Toll plaza")
merge_2 = Merge(Data1=ifcroadparts, Data2=ifcroadparts_2, Data3=ifcroadparts_3)
dup_6 = DuplicateData(Data=graft(merge_2), Number=lng_4, Order=True)  # -> simplify(Data)

# ----
# FacilityPartNamesAssemblies
lng_5 = ListLength(List=mesh)
panel_6 = Panel("""Part 4
Part 5
Part 6""")
dup_7 = DuplicateData(Data=graft(panel_6), Number=lng_5, Order=True)  # -> simplify(Data)

# ----
# FacilityPartTypesAssemblies
ifcrailwayparts = IFCRailwayParts({"Dilatation superstructure", "Line side structure", "Line side structure part", "Plain track superstructure", "Supestructure", "Track structure", "Track structure part", "Turnout superstructure", "Not defined"}, selected="Turnout superstructure")
ifcrailwayparts_2 = IFCRailwayParts({"Dilatation superstructure", "Line side structure", "Line side structure part", "Plain track superstructure", "Supestructure", "Track structure", "Track structure part", "Turnout superstructure", "Not defined"}, selected="Dilatation superstructure")
ifcrailwayparts_3 = IFCRailwayParts({"Dilatation superstructure", "Line side structure", "Line side structure part", "Plain track superstructure", "Supestructure", "Track structure", "Track structure part", "Turnout superstructure", "Not defined"}, selected="Plain track superstructure")
merge_3 = Merge(Data1=ifcrailwayparts, Data2=ifcrailwayparts_2, Data3=ifcrailwayparts_3)
dup_8 = DuplicateData(Data=graft(merge_3), Number=lng_5, Order=True)  # -> simplify(Data)

# ----
# FacilityPartNamesAssemblies
lng_6 = ListLength(List=mesh)
panel_7 = Panel("""Abutment A1
Pier P3
Deck""")
dup_9 = DuplicateData(Data=graft(panel_7), Number=lng_6, Order=True)  # -> simplify(Data)

# ----
# FacilityPartTypesAssemblies
ifcbridgeparts = IFCBridgeParts({"Abutment", "Deck", "Deck segment", "Foundation", "Pier", "Pier segment", "Pylon", "Substructure", "Superstructure", "Surfacestructure", "Not defined"}, selected="Abutment")
ifcbridgeparts_2 = IFCBridgeParts({"Abutment", "Deck", "Deck segment", "Foundation", "Pier", "Pier segment", "Pylon", "Substructure", "Superstructure", "Surfacestructure", "Not defined"}, selected="Pier")
ifcbridgeparts_3 = IFCBridgeParts({"Abutment", "Deck", "Deck segment", "Foundation", "Pier", "Pier segment", "Pylon", "Substructure", "Superstructure", "Surfacestructure", "Not defined"}, selected="Deck")
merge_4 = Merge(Data1=ifcbridgeparts, Data2=ifcbridgeparts_2, Data3=ifcbridgeparts_3)
dup_10 = DuplicateData(Data=graft(merge_4), Number=lng_6, Order=True)  # -> simplify(Data)

# ----
# FacilityPartNames
lng_7 = ListLength(List=mesh_elements)
panel_8 = Panel("""Part 1
Part 2
Part 3
Part 4
Part 5""")
dup_11 = DuplicateData(Data=graft(panel_8), Number=lng_7, Order=True)  # -> simplify(Data)

# ----
# FacilityPartTypes
ifcmarineparts_4 = IFCMarineParts({"Above water line", "Anchorage", "Approach channel", "Below water line", "Berthing structure", "Chamber", "Cill level", "Cope level", "Core", "Crest", "Gatehead", "Guding structure", "High water line", "Landfield", "Leeward side", "Low water line", "Manufacturing", "Navigational area", "Protection", "Ship transfer", "Storage area", "Vehicle servicing", "Waterfield", "Weather side", "Not defined"}, selected="Protection")
ifcmarineparts_5 = IFCMarineParts({"Above water line", "Anchorage", "Approach channel", "Below water line", "Berthing structure", "Chamber", "Cill level", "Cope level", "Core", "Crest", "Gatehead", "Guding structure", "High water line", "Landfield", "Leeward side", "Low water line", "Manufacturing", "Navigational area", "Protection", "Ship transfer", "Storage area", "Vehicle servicing", "Waterfield", "Weather side", "Not defined"}, selected="Chamber")
ifcmarineparts_6 = IFCMarineParts({"Above water line", "Anchorage", "Approach channel", "Below water line", "Berthing structure", "Chamber", "Cill level", "Cope level", "Core", "Crest", "Gatehead", "Guding structure", "High water line", "Landfield", "Leeward side", "Low water line", "Manufacturing", "Navigational area", "Protection", "Ship transfer", "Storage area", "Vehicle servicing", "Waterfield", "Weather side", "Not defined"}, selected="Landfield")
ifcmarineparts_7 = IFCMarineParts({"Above water line", "Anchorage", "Approach channel", "Below water line", "Berthing structure", "Chamber", "Cill level", "Cope level", "Core", "Crest", "Gatehead", "Guding structure", "High water line", "Landfield", "Leeward side", "Low water line", "Manufacturing", "Navigational area", "Protection", "Ship transfer", "Storage area", "Vehicle servicing", "Waterfield", "Weather side", "Not defined"}, selected="Waterfield")
ifcmarineparts_8 = IFCMarineParts({"Above water line", "Anchorage", "Approach channel", "Below water line", "Berthing structure", "Chamber", "Cill level", "Cope level", "Core", "Crest", "Gatehead", "Guding structure", "High water line", "Landfield", "Leeward side", "Low water line", "Manufacturing", "Navigational area", "Protection", "Ship transfer", "Storage area", "Vehicle servicing", "Waterfield", "Weather side", "Not defined"}, selected="Gatehead")
merge_5 = Merge(Data1=ifcmarineparts_4, Data2=ifcmarineparts_5, Data3=ifcmarineparts_6, Data4=ifcmarineparts_7, Data5=ifcmarineparts_8)
dup_12 = DuplicateData(Data=graft(merge_5), Number=lng_7, Order=True)  # -> simplify(Data)

# ----
# FacilityPartNames
lng_8 = ListLength(List=mesh_elements)
panel_9 = Panel("""Part 1
Part 2
Part 3
Part 4
Part 5""")
dup_13 = DuplicateData(Data=graft(panel_9), Number=lng_8, Order=True)  # -> simplify(Data)

# ----
# FacilityPartTypes
ifcroadparts_4 = IFCRoadParts({"Bicycle crossing", "Bus stop", "Carriageway", "Central island", "Central reserve", "Hard shoudler", "Intersection", "Layby", "Parking bay", "Passing bay", "Pedestrian crossing", "Railway crossing", "Refuge island", "Road segment", "Road side", "Road side part", "Roadway plateau", "Roundabout", "Shoulder", "Sidewalk", "Soft shoulder", "Toll plaza", "Trafic island", "Traffic lane", "Not defined"}, selected="Central reserve")
ifcroadparts_5 = IFCRoadParts({"Bicycle crossing", "Bus stop", "Carriageway", "Central island", "Central reserve", "Hard shoudler", "Intersection", "Layby", "Parking bay", "Passing bay", "Pedestrian crossing", "Railway crossing", "Refuge island", "Road segment", "Road side", "Road side part", "Roadway plateau", "Roundabout", "Shoulder", "Sidewalk", "Soft shoulder", "Toll plaza", "Trafic island", "Traffic lane", "Not defined"}, selected="Passing bay")
ifcroadparts_6 = IFCRoadParts({"Bicycle crossing", "Bus stop", "Carriageway", "Central island", "Central reserve", "Hard shoudler", "Intersection", "Layby", "Parking bay", "Passing bay", "Pedestrian crossing", "Railway crossing", "Refuge island", "Road segment", "Road side", "Road side part", "Roadway plateau", "Roundabout", "Shoulder", "Sidewalk", "Soft shoulder", "Toll plaza", "Trafic island", "Traffic lane", "Not defined"}, selected="Shoulder")
ifcroadparts_7 = IFCRoadParts({"Bicycle crossing", "Bus stop", "Carriageway", "Central island", "Central reserve", "Hard shoudler", "Intersection", "Layby", "Parking bay", "Passing bay", "Pedestrian crossing", "Railway crossing", "Refuge island", "Road segment", "Road side", "Road side part", "Roadway plateau", "Roundabout", "Shoulder", "Sidewalk", "Soft shoulder", "Toll plaza", "Trafic island", "Traffic lane", "Not defined"}, selected="Layby")
ifcroadparts_8 = IFCRoadParts({"Bicycle crossing", "Bus stop", "Carriageway", "Central island", "Central reserve", "Hard shoudler", "Intersection", "Layby", "Parking bay", "Passing bay", "Pedestrian crossing", "Railway crossing", "Refuge island", "Road segment", "Road side", "Road side part", "Roadway plateau", "Roundabout", "Shoulder", "Sidewalk", "Soft shoulder", "Toll plaza", "Trafic island", "Traffic lane", "Not defined"}, selected="Carriageway")
merge_6 = Merge(Data1=ifcroadparts_4, Data2=ifcroadparts_5, Data3=ifcroadparts_6, Data4=ifcroadparts_7, Data5=ifcroadparts_8)
dup_14 = DuplicateData(Data=graft(merge_6), Number=lng_8, Order=True)  # -> simplify(Data)

# ----
# FacilityPartNames
lng_9 = ListLength(List=mesh_elements)
panel_10 = Panel("""Part 1
Part 2
Part 3
Part 4
Part 5""")
dup_15 = DuplicateData(Data=graft(panel_10), Number=lng_9, Order=True)  # -> simplify(Data)

# ----
# FacilityPartTypes
ifcrailwayparts_4 = IFCRailwayParts({"Dilatation superstructure", "Line side structure", "Line side structure part", "Plain track superstructure", "Supestructure", "Track structure", "Track structure part", "Turnout superstructure", "Not defined"}, selected="Line side structure")
ifcrailwayparts_5 = IFCRailwayParts({"Dilatation superstructure", "Line side structure", "Line side structure part", "Plain track superstructure", "Supestructure", "Track structure", "Track structure part", "Turnout superstructure", "Not defined"}, selected="Track structure part")
ifcrailwayparts_6 = IFCRailwayParts({"Dilatation superstructure", "Line side structure", "Line side structure part", "Plain track superstructure", "Supestructure", "Track structure", "Track structure part", "Turnout superstructure", "Not defined"}, selected="Supestructure")
ifcrailwayparts_7 = IFCRailwayParts({"Dilatation superstructure", "Line side structure", "Line side structure part", "Plain track superstructure", "Supestructure", "Track structure", "Track structure part", "Turnout superstructure", "Not defined"}, selected="Turnout superstructure")
ifcrailwayparts_8 = IFCRailwayParts({"Dilatation superstructure", "Line side structure", "Line side structure part", "Plain track superstructure", "Supestructure", "Track structure", "Track structure part", "Turnout superstructure", "Not defined"}, selected="Dilatation superstructure")
merge_7 = Merge(
    Data1=ifcrailwayparts_4,
    Data2=ifcrailwayparts_5,
    Data3=ifcrailwayparts_6,
    Data4=ifcrailwayparts_7,
    Data5=ifcrailwayparts_8)
dup_16 = DuplicateData(Data=graft(merge_7), Number=lng_9, Order=True)  # -> simplify(Data)

# ----
# FacilityPartNames
lng_10 = ListLength(List=mesh_elements)
panel_11 = Panel("""Abutment A1
Pier P2
Pier P3
Abutment A4
Main superstructure""")
dup_17 = DuplicateData(Data=graft(panel_11), Number=lng_10, Order=True)  # -> simplify(Data)

# ----
# FacilityPartTypes
ifcbridgeparts_4 = IFCBridgeParts({"Abutment", "Deck", "Deck segment", "Foundation", "Pier", "Pier segment", "Pylon", "Substructure", "Superstructure", "Surfacestructure", "Not defined"}, selected="Abutment")
ifcbridgeparts_5 = IFCBridgeParts({"Abutment", "Deck", "Deck segment", "Foundation", "Pier", "Pier segment", "Pylon", "Substructure", "Superstructure", "Surfacestructure", "Not defined"}, selected="Pier")
ifcbridgeparts_6 = IFCBridgeParts({"Abutment", "Deck", "Deck segment", "Foundation", "Pier", "Pier segment", "Pylon", "Substructure", "Superstructure", "Surfacestructure", "Not defined"}, selected="Pier")
ifcbridgeparts_7 = IFCBridgeParts({"Abutment", "Deck", "Deck segment", "Foundation", "Pier", "Pier segment", "Pylon", "Substructure", "Superstructure", "Surfacestructure", "Not defined"}, selected="Abutment")
ifcbridgeparts_8 = IFCBridgeParts({"Abutment", "Deck", "Deck segment", "Foundation", "Pier", "Pier segment", "Pylon", "Substructure", "Superstructure", "Surfacestructure", "Not defined"}, selected="Superstructure")
merge_8 = Merge(Data1=ifcbridgeparts_4, Data2=ifcbridgeparts_5, Data3=ifcbridgeparts_6, Data4=ifcbridgeparts_7, Data5=ifcbridgeparts_8)
dup_18 = DuplicateData(Data=graft(merge_8), Number=lng_10, Order=True)  # -> simplify(Data)

# ----
# Facility type
ifcfacilitytypes = IFCFacilityTypes({"Building", "Bridge", "Marine", "Road", "Railway"}, selected="Marine")
ifcmarinefacilitytypes = IFCMarineFacilityTypes({"Barrier beach", "Breakwater", "Canal", "Drydock", "Floatingdock", "Hydrolift", "Jetty", "Launch recovery", "Marine defence", "Navigational channel", "Port", "Quay", "Revetment", "Shiplift", "Shiplock", "Shipyard", "Slipway", "Waterway", "Waterway shiplift", "Not defined"}, selected="Port")

# ----
# Create ElementAssemblies
ifcelementassembl = IFCElementAssembly(
    FacilityType=ifcfacilitytypes,
    FacilityPartName=dup_3,
    FacilityPartType=dup_4,
    GeometryElements=mesh,
    Colours=python.ColorsAss,
    ElementNames=python.NamesAss,
    IFCElementTypes=python.IFCTypesAss,
    UDAKeys=python.UDAKeysAss,
    UDAValues=python.UDAValuesAss,
    UDAPropertySets=python.PSetsAss,
    IFCLayers=python.LayersAss)

# ----
# Facility type
ifcfacilitytypes_2 = IFCFacilityTypes({"Building", "Bridge", "Marine", "Road", "Railway"}, selected="Road")
ifcroadtypes = IFCRoadTypes({"Not defined"}, selected="Not defined")

# ----
# Create ElementAssemblies
ifcelementassembl_2 = IFCElementAssembly(
    FacilityType=ifcfacilitytypes_2,
    FacilityPartName=dup_5,
    FacilityPartType=dup_6,
    GeometryElements=mesh,
    Colours=python.ColorsAss,
    ElementNames=python.NamesAss,
    IFCElementTypes=python.IFCTypesAss,
    UDAKeys=python.UDAKeysAss,
    UDAValues=python.UDAValuesAss,
    UDAPropertySets=python.PSetsAss,
    IFCLayers=python.LayersAss)

# ----
# Facility type
ifcfacilitytypes_3 = IFCFacilityTypes({"Building", "Bridge", "Marine", "Road", "Railway"}, selected="Railway")
ifcrailwaytypes = IFCRailwayTypes({"Not defined"}, selected="Not defined")

# ----
# Create ElementAssemblies
ifcelementassembl_3 = IFCElementAssembly(
    FacilityType=ifcfacilitytypes_3,
    FacilityPartName=dup_7,
    FacilityPartType=dup_8,
    GeometryElements=mesh,
    Colours=python.ColorsAss,
    ElementNames=python.NamesAss,
    IFCElementTypes=python.IFCTypesAss,
    UDAKeys=python.UDAKeysAss,
    UDAValues=python.UDAValuesAss,
    UDAPropertySets=python.PSetsAss,
    IFCLayers=python.LayersAss)

# ----
# Facility type
ifcbridgetypes = IFCBridgeTypes({"Arched", "Cable stayed", "Cantilever", "Culvert", "Framework", "Girder", "Suspension", "Truss", "Not defined"}, selected="Cable stayed")
ifcfacilitytypes_4 = IFCFacilityTypes({"Building", "Bridge", "Marine", "Road", "Railway"}, selected="Bridge")

# ----
# Create ElementAssemblies
ifcelementassembl_4 = IFCElementAssembly(
    FacilityType=ifcfacilitytypes_4,
    FacilityPartName=dup_9,
    FacilityPartType=dup_10,
    GeometryElements=mesh,
    Colours=python.ColorsAss,
    ElementNames=python.NamesAss,
    IFCElementTypes=python.IFCTypesAss,
    UDAKeys=python.UDAKeysAss,
    UDAValues=python.UDAValuesAss,
    UDAPropertySets=python.PSetsAss,
    IFCLayers=python.LayersAss)

# ----
# EndPoints - IFC Export IFC 4x3
# Facility type
ifcfacilitytypes_5 = IFCFacilityTypes({"Building", "Bridge", "Marine", "Road", "Railway"}, selected="Building")

# ----
# Create ElementAssemblies
ifcelementassembl_5 = IFCElementAssembly(
    FacilityType=ifcfacilitytypes_5,
    FacilityPartName=dup_2,
    GeometryElements=mesh,
    Colours=python.ColorsAss,
    ElementNames=python.NamesAss,
    IFCElementTypes=python.IFCTypesAss,
    UDAKeys=python.UDAKeysAss,
    UDAValues=python.UDAValuesAss,
    UDAPropertySets=python.PSetsAss,
    IFCLayers=python.LayersAss)

# ----
# Marine
concat = Concatenate(FragmentA=filename, FragmentB=ifcfacilitytypes, FragmentC="_4.3")

# ----
# Road
concat_2 = Concatenate(FragmentA=filename, FragmentB=ifcfacilitytypes_2, FragmentC="_4.3")

# ----
# Railway
concat_3 = Concatenate(FragmentA=filename, FragmentB=ifcfacilitytypes_3, FragmentC="_4.3")

# ----
# Bridge
concat_4 = Concatenate(FragmentA=filename, FragmentB=ifcfacilitytypes_4, FragmentC="_4.3")

# ----
# Building
concat_5 = Concatenate(FragmentA=filename, FragmentB=ifcfacilitytypes_5, FragmentC="_4.3")

# ----
# IFC Export - Building
ifcexport = IFCExport(
    Export=button,
    FileName=concat,
    Directory=path,
    IFCSchema=ifcschema,
    ProjectName=ifcfacilitytypes,
    FacilityType=ifcfacilitytypes,
    FacilitySubType=ifcmarinefacilitytypes,
    FacilityName=concat,
    FacilityPartsNames=dup_11,
    FacilityPartsTypes=dup_12,
    GeometryElements=mesh_elements,
    ElementAssemblyElements=ifcelementassembl,
    ElementNames=python.Names,
    Colours=python.Colors,
    IFCElementTypes=python.IFCTypes,
    UDAKeys=python.UDAKeys,
    UDAValues=python.UDAValues,
    UDAPropertySets=python.PSets,
    IFCLayers=python.Layers)

# ----
# IFC Export - Building
ifcexport_2 = IFCExport(
    Export=button,
    FileName=concat_2,
    Directory=path,
    IFCSchema=ifcschema,
    ProjectName=ifcfacilitytypes_2,
    FacilityType=ifcfacilitytypes_2,
    FacilitySubType=ifcroadtypes,
    FacilityName=concat_2,
    FacilityPartsNames=dup_13,
    FacilityPartsTypes=dup_14,
    GeometryElements=mesh_elements,
    ElementAssemblyElements=ifcelementassembl_2,
    ElementNames=python.Names,
    Colours=python.Colors,
    IFCElementTypes=python.IFCTypes,
    UDAKeys=python.UDAKeys,
    UDAValues=python.UDAValues,
    UDAPropertySets=python.PSets,
    IFCLayers=python.Layers)

# ----
# IFC Export - Building
ifcexport_3 = IFCExport(
    Export=button,
    FileName=concat_3,
    Directory=path,
    IFCSchema=ifcschema,
    ProjectName=ifcfacilitytypes_3,
    FacilityType=ifcfacilitytypes_3,
    FacilitySubType=ifcrailwaytypes,
    FacilityName=concat_3,
    FacilityPartsNames=dup_15,
    FacilityPartsTypes=dup_16,
    GeometryElements=mesh_elements,
    ElementAssemblyElements=ifcelementassembl_3,
    ElementNames=python.Names,
    Colours=python.Colors,
    IFCElementTypes=python.IFCTypes,
    UDAKeys=python.UDAKeys,
    UDAValues=python.UDAValues,
    UDAPropertySets=python.PSets,
    IFCLayers=python.Layers)

# ----
# IFC Export - Building
ifcexport_4 = IFCExport(
    Export=button,
    FileName=concat_4,
    Directory=path,
    IFCSchema=ifcschema,
    ProjectName=ifcfacilitytypes_4,
    FacilityType=ifcfacilitytypes_4,
    FacilitySubType=ifcbridgetypes,
    FacilityName=concat_4,
    FacilityPartsNames=dup_17,
    FacilityPartsTypes=dup_18,
    GeometryElements=mesh_elements,
    ElementAssemblyElements=ifcelementassembl_4,
    ElementNames=python.Names,
    Colours=python.Colors,
    IFCElementTypes=python.IFCTypes,
    UDAKeys=python.UDAKeys,
    UDAValues=python.UDAValues,
    UDAPropertySets=python.PSets,
    IFCLayers=python.Layers)

# ----
# IFC Export - Building
ifcexport_5 = IFCExport(
    Export=button,
    FileName=concat_5,
    Directory=path,
    IFCSchema=ifcschema,
    ProjectName=ifcfacilitytypes_5,
    FacilityType=ifcfacilitytypes_5,
    FacilitySubType="Building",
    FacilityName=concat_5,
    FacilityPartsNames=dup,
    GeometryElements=mesh_elements,
    ElementAssemblyElements=ifcelementassembl_5,
    ElementNames=python.Names,
    Colours=python.Colors,
    IFCElementTypes=python.IFCTypes,
    UDAKeys=python.UDAKeys,
    UDAValues=python.UDAValues,
    UDAPropertySets=python.PSets,
    IFCLayers=python.Layers)

# ----
# FacilityPartNamesAssemblies
panel_12 = Panel("""Storey 03
Storey 01
Storey 06""")
lng_11 = ListLength(List=python.GeometryAss)
dup_19 = DuplicateData(Data=graft(panel_12), Number=lng_11, Order=True)  # -> simplify(Data)

# ----
# FacilityPartNames
panel_13 = Panel("""Storey 01
Storey 02
Storey 03
Storey 04
Storey 05""")
lng_12 = ListLength(List=python.Geometry)
dup_20 = DuplicateData(Data=graft(panel_13), Number=lng_12, Order=True)  # -> simplify(Data)

# ----
# FacilityPartNames
panel_14 = Panel("""Storey 01
Storey 02
Storey 03
Storey 04
Storey 05""")
lng_13 = ListLength(List=python.Geometry)
dup_21 = DuplicateData(Data=graft(panel_14), Number=lng_13, Order=True)  # -> simplify(Data)

# ----
# FacilityPartNamesAssemblies
# EndPoints - IFC Export IFC 2x3
panel_15 = Panel("""Storey 03
Storey 01
Storey 06""")
lng_14 = ListLength(List=python.GeometryAss)
dup_22 = DuplicateData(Data=graft(panel_15), Number=lng_14, Order=True)  # -> simplify(Data)

# ----
# EndPoints - IFC Export IFC 4
# Create ElementAssemblies
ifcelementassembly = IFCElementAssembly(
    FacilityPartName=dup_22,
    GeometryElements=mesh,
    Colours=python.ColorsAss,
    ElementNames=python.NamesAss,
    IFCElementTypes=python.IFCTypesAss,
    UDAKeys=python.UDAKeysAss,
    UDAValues=python.UDAValuesAss,
    UDAPropertySets=python.PSetsAss)

# ----
# Create ElementAssemblies
ifcelementassembly_2 = IFCElementAssembly(
    FacilityPartName=dup_22,
    GeometryElements=mesh,
    Colours=python.ColorsAss,
    ElementNames=dup_19,
    IFCElementTypes=python.IFCTypesAss,
    UDAKeys=python.UDAKeysAss,
    UDAValues=python.UDAValuesAss,
    UDAPropertySets=python.PSetsAss)

concat_6 = Concatenate(FragmentA=filename, FragmentC="_2x3")

concat_7 = Concatenate(FragmentA=filename, FragmentC="_4")

# ----
# IFC Export - Building
ifcexport_6 = IFCExport(
    Export=button,
    FileName=concat_6,
    Directory=path,
    IFCSchema=ifcschema_3,
    ProjectName="Project",
    FacilityType="Building",
    FacilitySubType="Building",
    FacilityName=concat_6,
    FacilityPartsNames=dup_20,
    GeometryElements=mesh_elements,
    ElementAssemblyElements=ifcelementassembly_2,
    ElementNames=python.Names,
    Colours=python.Colors,
    IFCElementTypes=python.IFCTypes,
    UDAKeys=python.UDAKeys,
    UDAValues=python.UDAValues,
    UDAPropertySets=python.PSets,
    IFCLayers=python.Layers)

# ----
# IFC Export - Building
ifcexport_7 = IFCExport(
    Export=button,
    FileName=concat_7,
    Directory=path,
    IFCSchema=ifcschema_2,
    ProjectName="Project",
    FacilityType="Building",
    FacilitySubType="Building",
    FacilityName=concat_7,
    FacilityPartsNames=dup_21,
    GeometryElements=mesh_elements,
    ElementAssemblyElements=ifcelementassembly,
    ElementNames=python.Names,
    Colours=python.Colors,
    IFCElementTypes=python.IFCTypes,
    UDAKeys=python.UDAKeys,
    UDAValues=python.UDAValues,
    UDAPropertySets=python.PSets,
    IFCLayers=python.Layers)
