# Grasshopper definition SampleFileIFC_1.3.4_IFC_ExportScheme2.gh (Grasshopper 1.0.7)

readdatafromrhino = GhPythonScript(AssemblyNameAttName="AssemblyName", AssemblyFilterAttName="Assembly", PSET_Separator="_", IFCTypeUDA="IFCType")  # -> Geometry, graft(Colors), graft(IFCTypes), UDAKeys, UDAValues, PSets, graft(Layers), graft(Names)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
# ---------- readdatafromrhino: Python ----------
import Rhino.Geometry as rg
import Rhino as r
import Grasshopper.DataTree as gdt
import Grasshopper as g
import Grasshopper.Kernel.Types as gkt
import Grasshopper.Kernel.Data as gkd
import System.Drawing as sd



# Filter geometry. Only Brep, Surfaces, Extrusions and Meshes are imported from Rhino
def FilterGeometry(ObjRef):
    if ObjRef.ObjectType == r.DocObjects.ObjectType.Brep:
        result = True
        geometry = gkt.GH_Brep(ObjRef.Geometry)
    elif ObjRef.ObjectType == r.DocObjects.ObjectType.Surface:
        result = True
        geometry = gkt.GH_Surface(ObjRef.Geometry)
    elif ObjRef.ObjectType == r.DocObjects.ObjectType.Extrusion:
        result = True
        geometry = gkt.GH_Surface(ObjRef.Geometry)
    elif ObjRef.ObjectType == r.DocObjects.ObjectType.Mesh:
        result = True
        geometry = gkt.GH_Mesh(ObjRef.Geometry)
    return result, geometry

# Get User strings from Rhino objects. If UDA contains separator it is imported to UDAKeys and UDAValues.
# If User string is equal to IFCTypeUDA it export IFCType 
def GetUDA(ObjRef):
    ObjIFCType = gkt.GH_String("ifcbuildingelementproxy")
    ObjUDAKeys = []
    ObjUDAValues = []
    ObjUDAPSets = []
    for x in range(len(ObjRef.Attributes.GetUserStrings())):
        if (ObjRef.Attributes.GetUserStrings().GetKey(x) == IFCTypeUDA):
            ObjIFCType = gkt.GH_String(ObjRef.Attributes.GetUserStrings().Get(x))
        elif (PSET_Separator in ObjRef.Attributes.GetUserStrings().GetKey(x)):
            ObjUDAKeys.append(gkt.GH_String(ObjRef.Attributes.GetUserStrings().GetKey(x).Split(PSET_Separator)[1]))
            ObjUDAPSets.append(gkt.GH_String(ObjRef.Attributes.GetUserStrings().GetKey(x).Split(PSET_Separator)[0]))
            ObjUDAValues.append(gkt.GH_String(ObjRef.Attributes.GetUserStrings().Get(x)))
    return ObjIFCType, ObjUDAPSets, ObjUDAKeys, ObjUDAValues
    
def GetName(ObjRef):
    name = ObjRef.Attributes.Name
    if (name is None):
        name = "Value_not_defined"
    return name

# Check  if element is part of assembly
def PartOfAssembly(ObjRef):
    if (ObjRef.Attributes.GetUserStrings()[AssemblyFilterAttName] == "Yes"):
        return True
    else:
        return False
        
# Check get assembly name
def DefineAssemlby(ObjRef):
    if (ObjRef.Attributes.GetUserStrings()[AssemblyFilterAttName] == "Yes"):
        return ObjRef.Attributes.GetUserStrings()[AssemblyNameAttName]
    else:
        return None

# Add element to assemblydictionary
def CheckKey(dic, key, value):
    if key in dic.keys():
        dic[key].append(value)
    else:
        dic[key] = [value]


# Output data trees - elements which are not part of assembly
FacilityParts = g.DataTree[gkt.GH_String]()
Colors = g.DataTree[gkt.GH_Colour]()
Layers = g.DataTree[gkt.GH_String]()
UDAKeys = g.DataTree[gkt.GH_String]()
UDAValues = g.DataTree[gkt.GH_String]()
PSets = g.DataTree[gkt.GH_String]()
IFCTypes = g.DataTree[gkt.GH_String]()
Geometry = g.DataTree[gkt.IGH_GeometricGoo]()
Names = g.DataTree[gkt.GH_String]()

# Output data trees - elements which are part of assembly
FacilityPartsAss = g.DataTree[gkt.GH_String]()
ColorsAss = g.DataTree[gkt.GH_Colour]()
LayersAss = g.DataTree[gkt.GH_String]()
UDAKeysAss = g.DataTree[gkt.GH_String]()
UDAValuesAss = g.DataTree[gkt.GH_String]()
PSetsAss = g.DataTree[gkt.GH_String]()
IFCTypesAss = g.DataTree[gkt.GH_String]()
GeometryAss = g.DataTree[gkt.IGH_GeometricGoo]()
NamesAss = g.DataTree[gkt.GH_String]()


# Get active document
doc = r.RhinoDoc.ActiveDoc
# Get layer table
layerTable = doc.Layers
# Get object table 
objectTable = doc.Objects

# Dictionary for elementassemblies
assemblyDictionary = {}

# Iterate over layers and filter assembly and not assembly elements. 
# Fill output trees for not assembly elements
for i in range(len(layerTable)):
    layer = layerTable[i]
    if (layer.IsVisible):
        path = gkd.GH_Path(i)
        # Get Rhino objects by layer
        ObjReferences = doc.Objects.FindByLayer(layer)
        if len(ObjReferences) > 0:
            # Iterate over all Rhino objects
            z = 0;
            for x in range(len(ObjReferences)):
                if (ObjReferences[x] is not None and ObjReferences[x].Visible):
                    pathUDA = gkd.GH_Path(i,z)
                    # Get color and layer of from layer
                    color = gkt.GH_Colour(sd.Color.FromArgb(0,layer.Color.R,layer.Color.G,layer.Color.B))
                    name = gkt.GH_String(GetName(ObjReferences[x]))
                    layerName = gkt.GH_String(layer.Name)
                    result, geometry = FilterGeometry(ObjReferences[x])
                    # Fill output trees for elements which are not part of assembly.
                    if (not PartOfAssembly(ObjReferences[x])):
                        if (result):
                            Colors.Add(color,path)
                            Names.Add(name, path)
                            Layers.Add(layerName,path)
                            FacilityParts.Add(layerName,path)
                            Geometry.Add(geometry,path)
                            objIFCType, objUDAPSets, objUDAKeys, objUDAValues = GetUDA(ObjReferences[x])
                            IFCTypes.Add(objIFCType, path)
                            PSets.AddRange(objUDAPSets, pathUDA)
                            UDAKeys.AddRange(objUDAKeys, pathUDA)
                            UDAValues.AddRange(objUDAValues, pathUDA)
                            z+=1
                    # Fill output trees for elements which are parts of element assembly.
                    else:
                        if (result):
                            assemblyName = DefineAssemlby(ObjReferences[x])
                            if (assemblyName is not None):
                                CheckKey(assemblyDictionary, assemblyName,ObjReferences[x])
                            
                            

# Iterate over assembly elements dictionary and fill output trees for assemblies
# Only layer of first item is used. (Assemblies should be in a separte layer) 
# dtto building stories and properties (user must develop own workflow to fit their needs)
i = 0
for assembly in assemblyDictionary.items():
    path = gkd.GH_Path(i)
    for x in range(len(assembly[1])):
        ObjReference = assembly[1][x]
        layer = layerTable.FindIndex(ObjReference.Attributes.LayerIndex)
        objIFCType, objUDAPSets, objUDAKeys, objUDAValues = GetUDA(ObjReference)
        name = gkt.GH_String(GetName(ObjReference))
        if x == 0:
            # Add layer
            LayersAss.Add(gkt.GH_String(layer.Name), path)
            # Add buildingStoreis
            FacilityPartsAss.Add(gkt.GH_String(layer.Name), path)
            PSetsAss.AddRange(objUDAPSets, path)
            UDAKeysAss.AddRange(objUDAKeys, path)
            UDAValuesAss.AddRange(objUDAValues, path)
        # Add IFCType 
        IFCTypesAss.Add(objIFCType, path)
        # Add color
        ColorsAss.Add(gkt.GH_Colour(sd.Color.FromArgb(0,layer.Color.R,layer.Color.G,layer.Color.B)), path)
        # Add name
        NamesAss.Add(name, path)
        # Add geometry
        result, geometry = FilterGeometry(ObjReference)
        GeometryAss.Add(geometry,path)
    i+=1
# ---------- end readdatafromrhino ----------
# Correct data structure!!
# Facility part by path is checked.
# Length of tree paths does not matter if it is  changed equally for all inputs.
tstat = TreeStatistics(Tree=readdatafromrhino.Geometry)  # -> Paths, Length, Count
facilitypartsnames_paths = Panel(tstat.Paths)
facilitypartsnames_items_in_branch = Panel(tstat.Length)
brep = Brep(graft(readdatafromrhino.Geometry))
path_mapper = PathMapper(readdatafromrhino.UDAKeys, source="{A;B}", target="{A;B;0}")
path_mapper_2 = PathMapper(readdatafromrhino.UDAValues, source="{A;B}", target="{A;B;0}")
path_mapper_3 = PathMapper(readdatafromrhino.PSets, source="{A;B}", target="{A;B;0}")
tstat_2 = TreeStatistics(Tree=brep)  # -> Paths, Length, Count
tstat_3 = TreeStatistics(Tree=readdatafromrhino.Geometry)  # -> Paths, Length, Count
tstat_4 = TreeStatistics(Tree=readdatafromrhino.IFCTypes)  # -> Paths, Length, Count
tstat_5 = TreeStatistics(Tree=path_mapper)  # -> Paths, Length, Count
geometries_paths = Panel(tstat_2.Paths)
geometries_items_in_branch = Panel(tstat_2.Length)
colors_paths = Panel(tstat_3.Paths)
colors_items_in_branch = Panel(tstat_3.Length)
ifcelementtypes_paths = Panel(tstat_4.Paths)
ifcelementtypes_items_in_branch = Panel(tstat_4.Length)
udakeys_paths = Panel(tstat_5.Paths)
udakeys_items_in_branch = Panel(tstat_5.Length)
tstat_6 = TreeStatistics(Tree=path_mapper_2)  # -> Paths, Length, Count
tstat_7 = TreeStatistics(Tree=path_mapper_3)  # -> Paths, Length, Count
tstat_8 = TreeStatistics(Tree=readdatafromrhino.Layers)  # -> Paths, Length, Count
tstat_9 = TreeStatistics(Tree=readdatafromrhino.Names)  # -> Paths, Length, Count
udavalues_paths = Panel(tstat_6.Paths)
udavalues_items_in_branch = Panel(tstat_6.Length)
udapsets_items_in_branch = Panel(tstat_7.Length)
elementnames_items_in_branch = Panel(tstat_9.Length)
udapsets_paths = Panel(tstat_7.Paths)
layers_paths = Panel(tstat_8.Paths)
layers_items_in_branch = Panel(tstat_8.Length)
elementnames_paths = Panel(tstat_9.Paths)
