# Grasshopper definition SampleFileIFC_1.4.0_IFC_ExportScheme2.gh (Grasshopper 1.0.7)

# Correct data structure!!
# Facility part by path is checked.
# Length of tree paths does not matter if it is changed equally for all inputs.
panel = Panel("AssemblyName")
python = GhPythonScript(
    AssemblyNameAttName=panel,
    AssemblyFilterAttName="AssemblyName",
    PSET_Separator="@",
    IFCElementType="IfcElementType",
    IfcPredefinedType="IfcElementPredefinedType",
    IFCGroup="GroupName",
    IFCSystem="SystemName",
    FacilityPartName="IfcFacilityPart",
    FacilityPartType="IfcFacilityPartType")  # -> graft(Geometry), graft(Colors), graft(IFCTypes), graft(ElementPredefinedTypes), UDAKeys, UDAValues, PSets, graft(Layers)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
# ---------- python: Python ----------
import Rhino.Geometry as rg
import Rhino as r
import Grasshopper.DataTree as gdt
import Grasshopper as g
import Grasshopper.Kernel.Types as gkt
import Grasshopper.Kernel.Data as gkd
import System.Drawing as sd

# Get active document
doc = r.RhinoDoc.ActiveDoc
# Get layer table
layerTable = doc.Layers
# Get object table 
objectTable = doc.Objects
# Get material table
materailTable = doc.Materials


# Filter geometry. Only Brep, Surfaces, Extrusions and Meshes are imported from Rhino
def FilterGeometry(ObjRef):
    if ObjRef.ObjectType == r.DocObjects.ObjectType.Brep:
        result = True
        geometry = gkt.GH_Brep(ObjRef.Geometry)
    elif ObjRef.ObjectType == r.DocObjects.ObjectType.Surface:
        result = True
        geometry = gkt.GH_Surface(ObjRef.Geometry)
    elif ObjRef.ObjectType == r.DocObjects.ObjectType.Extrusion:
        result = True
        geometry = gkt.GH_Surface(ObjRef.Geometry)
    elif ObjRef.ObjectType == r.DocObjects.ObjectType.Mesh:
        result = True
        geometry = gkt.GH_Mesh(ObjRef.Geometry)
    else:
        result = False
        geometry = None
    return result, geometry


# Get User strings from Rhino objects. If UDA contains separator it is imported to UDAKeys and UDAValues.
# If User string is equal to IFCElementType it export IFCType 
def GetUDA(ObjRef):
    ObjIFCType = gkt.GH_String("ifcbuildingelementproxy")
    ObjUDAKeys = []
    ObjUDAValues = []
    ObjUDAPSets = []
    for x in range(len(ObjRef.Attributes.GetUserStrings())):
        if (ObjRef.Attributes.GetUserStrings().GetKey(x) == IFCElementType):
            ObjIFCType = gkt.GH_String(ObjRef.Attributes.GetUserStrings().Get(x))
        elif (PSET_Separator in ObjRef.Attributes.GetUserStrings().GetKey(x)):
            ObjUDAKeys.append(gkt.GH_String(ObjRef.Attributes.GetUserStrings().GetKey(x).Split(PSET_Separator)[1]))
            ObjUDAPSets.append(gkt.GH_String(ObjRef.Attributes.GetUserStrings().GetKey(x).Split(PSET_Separator)[0]))
            ObjUDAValues.append(gkt.GH_String(ObjRef.Attributes.GetUserStrings().Get(x)))
    return ObjIFCType, ObjUDAPSets, ObjUDAKeys, ObjUDAValues

# Get element name
def GetName(ObjRef):
    name = ObjRef.Attributes.Name
    if (name is None):
        name = "Value_not_defined"
    return name

# Check if element is part of assembly
def PartOfAssembly(ObjRef):
    if (ObjRef.Attributes.GetUserStrings()[AssemblyFilterAttName] != None):
        return True, 
    else:
        return False

# Check if element is part of group
def PartOfGroup(ObjRef):
    if (ObjRef.Attributes.GetUserStrings()[IFCGroup] != None):
        return ObjRef.Attributes.GetUserStrings()[IFCGroup]
    else:
        return None
        
# Check if element is part of group
def PartOfSystem(ObjRef):
    if (ObjRef.Attributes.GetUserStrings()[IFCSystem] != None):
        return ObjRef.Attributes.GetUserStrings()[IFCSystem]
    else:
        return None
        
# Get assembly name
def DefineAssemlby(ObjRef):
    if (ObjRef.Attributes.GetUserStrings()[AssemblyFilterAttName] != None):
        return ObjRef.Attributes.GetUserStrings()[AssemblyNameAttName]
    else:
        return None
        
# Get facility part name
def GetFacilityPartName(ObjRef):
    if (ObjRef.Attributes.GetUserStrings()[FacilityPartName] != None):
        return ObjRef.Attributes.GetUserStrings()[FacilityPartName]
    else:
        return None
        
# Get facility part type name
def GetFacilityPartType(ObjRef):
    if (ObjRef.Attributes.GetUserStrings()[FacilityPartType] != None):
        return ObjRef.Attributes.GetUserStrings()[FacilityPartType]
    else:
        return None
        
# Get element predefined type
def GetElementPredefinedType(ObjRef):
    if (ObjRef.Attributes.GetUserStrings()[IfcPredefinedType] != None):
        return ObjRef.Attributes.GetUserStrings()[IfcPredefinedType]
    else:
        return None

# Add element to assemblydictionary
def CheckKey(dic, key, value):
    if key in dic.keys():
        dic[key].append(value)
    else:
        dic[key] = [value]

# Get material name
def GetMaterial(ObjRef):
    if (ObjRef.Attributes.MaterialSource == r.DocObjects.ObjectMaterialSource.MaterialFromLayer):
        if (layerTable.FindIndex(ObjRef.Attributes.LayerIndex).RenderMaterialIndex != -1):
            return materailTable[layerTable.FindIndex(ObjRef.Attributes.LayerIndex).RenderMaterialIndex].Name
    elif(ObjRef.Attributes.MaterialSource == r.DocObjects.ObjectMaterialSource.MaterialFromObject):
        if (ObjRef.Attributes.MaterialIndex != -1):
            return materailTable[ObjRef.Attributes.MaterialIndex].Name
    return None

if (Run):
    ghenv.Component.ExpireSolution(True)

# Output data trees - elements which are not part of assembly
FacilityParts = g.DataTree[gkt.GH_String]()
Colors = g.DataTree[gkt.GH_Colour]()
Layers = g.DataTree[gkt.GH_String]()
UDAKeys = g.DataTree[gkt.GH_String]()
UDAValues = g.DataTree[gkt.GH_String]()
PSets = g.DataTree[gkt.GH_String]()
IFCTypes = g.DataTree[gkt.GH_String]()
Geometry = g.DataTree[gkt.IGH_GeometricGoo]()
Names = g.DataTree[gkt.GH_String]()
Groups = g.DataTree[gkt.GH_String]()
Systems = g.DataTree[gkt.GH_String]()
Materials = g.DataTree[gkt.GH_String]()
FacilityPartNames = g.DataTree[gkt.GH_String]()
FacilityPartPredefinedTypes = g.DataTree[gkt.GH_String]()
ElementPredefinedTypes = g.DataTree[gkt.GH_String]()
# Output data trees - elements which are part of assembly
FacilityPartsAss = g.DataTree[gkt.GH_String]()
NameAss = g.DataTree[gkt.GH_String]()
ColorsAss = g.DataTree[gkt.GH_Colour]()
LayersAss = g.DataTree[gkt.GH_String]()
UDAKeysAss = g.DataTree[gkt.GH_String]()
UDAValuesAss = g.DataTree[gkt.GH_String]()
PSetsAss = g.DataTree[gkt.GH_String]()
IFCTypesAss = g.DataTree[gkt.GH_String]()
GeometryAss = g.DataTree[gkt.IGH_GeometricGoo]()
NamesAss = g.DataTree[gkt.GH_String]()
GroupsAss = g.DataTree[gkt.GH_String]()
SystemsAss = g.DataTree[gkt.GH_String]()
MaterialsAss = g.DataTree[gkt.GH_String]()
FacilityPartNamesAss = g.DataTree[gkt.GH_String]()
FacilityPartPredefinedTypesAss = g.DataTree[gkt.GH_String]()
ElementPredefinedTypesAss = g.DataTree[gkt.GH_String]()

# Dictionary for elementassemblies
assemblyDictionary = {}

# Iterate over layers and filter assembly and not assembly elements. 
# Fill output trees for not assembly elements
for i in range(len(layerTable)):
    layer = layerTable[i]
    if (layer.IsVisible):
        path = gkd.GH_Path(i)
        # Get Rhino objects by layer
        ObjReferences = doc.Objects.FindByLayer(layer)
        if len(ObjReferences) > 0:
            # Iterate over all Rhino objects
            z = 0;
            for x in range(len(ObjReferences)):
                if (ObjReferences[x] is not None and ObjReferences[x].Visible):
                    pathUDA = gkd.GH_Path(i,z)
                    # Get color and layer of from layer
                    color = gkt.GH_Colour(sd.Color.FromArgb(0,layer.Color.R,layer.Color.G,layer.Color.B))
                    name = gkt.GH_String(GetName(ObjReferences[x]))
                    layerName = gkt.GH_String(layer.Name)
                    result, geometry = FilterGeometry(ObjReferences[x])
                    group = PartOfGroup(ObjReferences[x])
                    system = PartOfSystem(ObjReferences[x])
                    material = GetMaterial(ObjReferences[x])
                    facilityPartName = GetFacilityPartName(ObjReferences[x])
                    facilityPartType = GetFacilityPartType(ObjReferences[x])
                    elementPredefinedType = GetElementPredefinedType(ObjReferences[x])
                    # Fill output trees for elements which are not part of assembly.
                    if (not PartOfAssembly(ObjReferences[x])):
                        if (result):
                            if (group != None):
                                Groups.Add(gkt.GH_String(group), path)
                            if (system != None):
                                Systems.Add(gkt.GH_String(system), path)
                            if (material != None):
                                Materials.Add(gkt.GH_String(material), path)
                            if (facilityPartName != None):
                                FacilityPartNames.Add(gkt.GH_String(facilityPartName), path)
                            if (facilityPartType != None):
                                FacilityPartPredefinedTypes.Add(gkt.GH_String(facilityPartType), path)
                            if (elementPredefinedType != None):
                                ElementPredefinedTypes.Add(gkt.GH_String(elementPredefinedType), path)
                            Colors.Add(color,path)
                            Names.Add(name, path)
                            Layers.Add(layerName,path)
                            FacilityParts.Add(layerName,path)
                            Geometry.Add(geometry,path)
                            objIFCType, objUDAPSets, objUDAKeys, objUDAValues = GetUDA(ObjReferences[x])
                            IFCTypes.Add(objIFCType, path)
                            PSets.AddRange(objUDAPSets, pathUDA)
                            UDAKeys.AddRange(objUDAKeys, pathUDA)
                            UDAValues.AddRange(objUDAValues, pathUDA)
                            
                            z+=1
                    # Fill output trees for elements which are parts of element assembly.
                    else:
                        if (result):
                            assemblyName = DefineAssemlby(ObjReferences[x])
                            if (assemblyName is not None):
                                CheckKey(assemblyDictionary, assemblyName,ObjReferences[x])
                            
                            

# Iterate over assembly elements dictionary and fill output trees for assemblies
# Only layer of first item is used. (Assemblies should be in a separte layer) 
# dtto building stories and properties (user must develop own workflow to fit their needs)
i = 0
for assembly in assemblyDictionary.items():
    path = gkd.GH_Path(i)
    for x in range(len(assembly[1])):
        ObjReference = assembly[1][x]
        layer = layerTable.FindIndex(ObjReference.Attributes.LayerIndex)
        objIFCType, objUDAPSets, objUDAKeys, objUDAValues = GetUDA(ObjReference)
        name = gkt.GH_String(GetName(ObjReference))
        group = PartOfGroup(ObjReference)
        system = PartOfSystem(ObjReference)
        material = GetMaterial(ObjReference)
        facilityPartName = GetFacilityPartName(ObjReference)
        facilityPartType = GetFacilityPartType(ObjReference)
        elementPredefinedType = GetElementPredefinedType(ObjReference)
        if (group != None):
            GroupsAss.Add(gkt.GH_String(group), path)
        if (system != None):
            SystemsAss.Add(gkt.GH_String(system), path)
        if (material != None):
            MaterialsAss.Add(gkt.GH_String(material), path)
        if (elementPredefinedType != None):
            ElementPredefinedTypesAss.Add(gkt.GH_String(elementPredefinedType), path)
        if x == 0:
            if (facilityPartName != None):
                FacilityPartNamesAss.Add(gkt.GH_String(facilityPartName), path)
            if (facilityPartType != None):
                FacilityPartPredefinedTypesAss.Add(gkt.GH_String(facilityPartType), path)
            # Add layer
            LayersAss.Add(gkt.GH_String(layer.Name), path)
            # Add buildingStoreis
            PSetsAss.AddRange(objUDAPSets, path)
            UDAKeysAss.AddRange(objUDAKeys, path)
            UDAValuesAss.AddRange(objUDAValues, path)
            NameAss.Add(gkt.GH_String(assembly[0]), path)
        # Add IFCType 
        IFCTypesAss.Add(objIFCType, path)
        # Add color
        ColorsAss.Add(gkt.GH_Colour(sd.Color.FromArgb(0,layer.Color.R,layer.Color.G,layer.Color.B)), path)
        # Add name
        NamesAss.Add(name, path)
        # Add geometry
        result, geometry = FilterGeometry(ObjReference)
        GeometryAss.Add(geometry,path)
    i+=1
# ---------- end python ----------
path_mapper = PathMapper(python.UDAKeys, source="{A;B}", target="{A;B;0}")
path_mapper_2 = PathMapper(python.UDAValues, source="{A;B}", target="{A;B;0}")
path_mapper_3 = PathMapper(python.PSets, source="{A;B}", target="{A;B;0}")
tstat = TreeStatistics(Tree=python.FacilityPartNames)  # -> Paths, Length, Count
tstat_2 = TreeStatistics(Tree=python.FacilityPartPredefinedTypes)  # -> Paths, Length, Count
facilitypartsnames_paths = Panel(tstat.Paths)
facilitypartsnames_items_in_branch = Panel(tstat.Length)
facilitypartspredefinedtypes_paths = Panel(tstat_2.Paths)
facilitypartspredefinedtypes_items_in_br = Panel(tstat_2.Length)  # "FacilityPartsPredefinedTypes - items in branch"
tstat_3 = TreeStatistics(Tree=python.Geometry)  # -> Paths, Length, Count
tstat_4 = TreeStatistics(Tree=python.Colors)  # -> Paths, Length, Count
tstat_5 = TreeStatistics(Tree=python.IFCTypes)  # -> Paths, Length, Count
tstat_6 = TreeStatistics(Tree=python.ElementPredefinedTypes)  # -> Paths, Length, Count
geometries_paths = Panel(tstat_3.Paths)
geometries_items_in_branch = Panel(tstat_3.Length)
colors_paths = Panel(tstat_4.Paths)
colors_items_in_branch = Panel(tstat_4.Length)
ifcelementtypes_paths = Panel(tstat_5.Paths)
ifcelementtypes_items_in_branch = Panel(tstat_5.Length)
ifcelementpredefinedtypes_paths = Panel(tstat_6.Paths)
ifcelementpredefinedtypes_items_in_branc = Panel(tstat_6.Length)  # "IFCElementPredefinedTypes - items in branch"
tstat_7 = TreeStatistics(Tree=path_mapper)  # -> Paths, Length, Count
tstat_8 = TreeStatistics(Tree=path_mapper_2)  # -> Paths, Length, Count
tstat_9 = TreeStatistics(Tree=path_mapper_3)  # -> Paths, Length, Count
tstat_10 = TreeStatistics(Tree=python.Layers)  # -> Paths, Length, Count
udavalues_paths = Panel(tstat_8.Paths)
udavalues_items_in_branch = Panel(tstat_8.Length)
udapsets_paths = Panel(tstat_9.Paths)
udapsets_items_in_branch = Panel(tstat_9.Length)
layers_paths = Panel(tstat_10.Paths)
layers_items_in_branch = Panel(tstat_10.Length)
udakeys_paths = Panel(tstat_7.Paths)
udakeys_items_in_branch = Panel(tstat_7.Length)
tstat_11 = TreeStatistics(Tree=python.Names)  # -> Paths, Length, Count
tstat_12 = TreeStatistics(Tree=python.Groups)  # -> Paths, Length, Count
tstat_13 = TreeStatistics(Tree=python.Systems)  # -> Paths, Length, Count
tstat_14 = TreeStatistics(Tree=python.Materials)  # -> Paths, Length, Count
elementnames_items_in_branch = Panel(tstat_11.Length)
elementnames_paths = Panel(tstat_11.Paths)
groups_paths = Panel(tstat_12.Paths)
groups_items_in_branch = Panel(tstat_12.Length)
systems_paths = Panel(tstat_13.Paths)
systems_items_in_branch = Panel(tstat_13.Length)
materials_paths = Panel(tstat_14.Paths)
materials_items_in_branch = Panel(tstat_14.Length)
