# Grasshopper definition ImportLandXMLSample1.gh (Grasshopper 1.0.7)
# Copyright: Ondřej Janota
# plug-ins: EndPoints

# ----
# Overpass - alignment + sections
# Reference files
path_to_xml_with_alignment = FilePath(flatten("C:\Users\A408201\Desktop\EndPoints_1.4\XML\Overpass - alignment + sections.xml"))
select_profile_with_start_and_end_statio = Slider(0, range=0..2)  # "Select profile with start and end stationing"
define_step = Panel("0.1")

# ----
# Reference files
select_profile = Slider(0, range=0..3)
path_to_xml_with_cross_sections = FilePath(flatten("C:\Users\A408201\Desktop\EndPoints_1.4\XML\MainRoad- - alignment + sections.xml"))
start_stationing_of_imported_part = Panel("29000")
end_stationing_of_imported_part = Panel("31000")
path_to_xml_with_alignment_2 = FilePath(flatten("C:\Users\A408201\Desktop\EndPoints_1.4\XML\Main road - alignment.xml"))
flow_step = Panel("2")

# ----
# Reference files
path_to_xml_with_dtm = FilePath("C:\Users\A408201\Desktop\EndPoints_1.4\XML\DTM+MainRoadSurface.xml")
boundary_curve = Curve()

# ----
# Select terrain name
surfnames = SurfaceNames(PathToXML=path_to_xml_with_dtm)  # -> SurfaceNames, Namespace

# ----
# Select alignment
# name and profiles
alignames = AlignmentNames(PathToXML=path_to_xml_with_alignment_2)  # -> AlignemntNames, ProfileNames, StartStationing, EndStationing, Namespace

# ----
# Main road - alignment + sections
alignames_2 = AlignmentNames(PathToXML=path_to_xml_with_cross_sections)  # -> AlignemntNames, ProfileNames, StartStationing, EndStationing, Namespace
item = ListItem(List=alignames.ProfileNames, Index=select_profile, Wrap=True)

# ----
# Select alignment
# name and profiles
alignames_3 = AlignmentNames(PathToXML=path_to_xml_with_alignment)  # -> AlignemntNames, ProfileNames, StartStationing, EndStationing, Namespace
item_2 = ListItem(List=alignames_3.ProfileNames, Index=select_profile_with_start_and_end_statio, Wrap=True)
item_3 = ListItem(List=alignames_3.StartStationing, Index=select_profile_with_start_and_end_statio, Wrap=True)
item_4 = ListItem(List=alignames_3.EndStationing, Index=select_profile_with_start_and_end_statio, Wrap=True)

# ----
# Main road terrain and corridor surfaces
item_5 = ListItem(List=surfnames.SurfaceNames, Index=0, Wrap=True)  # -> Item, Item1, Item2

# ----
# Imported alignment
# and cross-sections
# Move sections to proper elevation.
createcrosssections = CreateCrossSections(AlignemntNames=alignames_3.AlignemntNames, StartStationing=item_3, EndStationing=item_4, Namespace=alignames_3.Namespace)  # -> CrossSectionsCurves, SectionCurveNames, SectionCurveStationing, DesignCrossSectionsCurves, DesignSectionCurveNames, DesignSectionCurveStationing
createalignment = CreateAlignment(
    AlignmentNames=alignames_3.AlignemntNames,
    ProfileNames=item_2,
    StartStationing=item_3,
    EndStationing=item_4,
    Namespace=alignames_3.Namespace,
    Step=define_step)  # -> Alignment3D, AlignmentXY, Profile, StartSta, EndSta, Difference
python = GhPythonScript(
    Alignment3D=createalignment.Alignment3D,
    StartAlignmentStationing=item_3,
    SectionCurveStationing=createcrosssections.SectionCurveStationing,
    CrossSectionsCurves=createcrosssections.CrossSectionsCurves,
    DesignCrossSectionsCurvesStationing=createcrosssections.DesignSectionCurveStationing,
    DesignCrossSectionsCurves=createcrosssections.DesignCrossSectionsCurves)  # -> SectionCurveNames, DesignCrossSectionsCurves; inputs Alignment3D: Curve, CrossSectionsCurves: list of Curve, DesignCrossSectionsCurves: list of Curve
# ---------- python: Python ----------
import Rhino.Geometry as rg
import Rhino as r

# Project alignment to XY plane
alignment = Alignment3D.DuplicateCurve()
alignment.Transform(rg.Transform.PlanarProjection(rg.Plane.WorldXY))




# Calculate points, tangent and plane at given stationing
if (SectionCurveStationing != None):
    parameter = alignment.LengthParameter(SectionCurveStationing-StartAlignmentStationing)
    point = alignment.PointAt(parameter[1])
    tangent = alignment.TangentAt(parameter[1])
    plane = rg.Plane(point, tangent)

    # Calculate intersection with original alignment
    point3d = rg.Intersect.Intersection.CurvePlane(Alignment3D, plane, r.RhinoMath.ZeroTolerance)[0].PointA

    for section in CrossSectionsCurves:
        section.Transform(rg.Transform.Translation(point3d-point))

if (DesignCrossSectionsCurvesStationing != None):
    # Calculate points, tangent and plane at given stationing
    parameter = alignment.LengthParameter(DesignCrossSectionsCurvesStationing-StartAlignmentStationing)
    point = alignment.PointAt(parameter[1])
    tangent = alignment.TangentAt(parameter[1])
    plane = rg.Plane(point, tangent)
    
    # Calculate intersection with original alignment
    point3d = rg.Intersect.Intersection.CurvePlane(Alignment3D, plane, r.RhinoMath.ZeroTolerance)[0].PointA
    
    for section in DesignCrossSectionsCurves:
        section.Transform(rg.Transform.Translation(point3d-point))
# ---------- end python ----------

# ----
# Imported alignment
# and cross-sections
# Move sections to proper elevation.
createcrosssections_2 = CreateCrossSections(
    AlignemntNames=alignames_2.AlignemntNames,
    StartStationing=start_stationing_of_imported_part,
    EndStationing=end_stationing_of_imported_part,
    Namespace=alignames_2.Namespace)  # -> CrossSectionsCurves, SectionCurveNames, SectionCurveStationing, DesignCrossSectionsCurves, DesignSectionCurveNames, DesignSectionCurveStationing
createalignment_2 = CreateAlignment(
    AlignmentNames=alignames.AlignemntNames,
    ProfileNames=item,
    StartStationing=start_stationing_of_imported_part,
    EndStationing=end_stationing_of_imported_part,
    Namespace=alignames.Namespace,
    Step=flow_step)  # -> Alignment3D, AlignmentXY, Profile, StartSta, EndSta, Difference
python_2 = GhPythonScript(
    Alignment3D=createalignment_2.Alignment3D,
    StartAlignmentStationing=start_stationing_of_imported_part,
    SectionCurveStationing=createcrosssections_2.SectionCurveStationing,
    CrossSectionsCurves=createcrosssections_2.CrossSectionsCurves,
    DesignCrossSectionsCurvesStationing=createcrosssections_2.DesignSectionCurveStationing,
    DesignCrossSectionsCurves=createcrosssections_2.DesignCrossSectionsCurves)  # -> SectionCurveNames, DesignCrossSectionsCurves; inputs Alignment3D: Curve, CrossSectionsCurves: list of Curve, DesignCrossSectionsCurves: list of Curve; same code as python

# ----
# Imported corridor surface
createsurface = CreateSurface(SurfaceNames=item_5.Item2, SurfaceBoundary=boundary_curve, Namespace=surfnames.Namespace)  # -> Surface, Breaklines

# ----
# Imported terrain
createsurface_2 = CreateSurface(SurfaceNames=item_5.Item, SurfaceBoundary=boundary_curve, Namespace=surfnames.Namespace)  # -> Surface, Breaklines
