# Grasshopper definition ImportLandXMLSample2.gh (Grasshopper 1.0.7)
# plug-ins: EndPoints

# ----
# Import all surfaces from .XML file
# Import surfaces
# Surface names
path_to_xml_with_surfaces = FilePath()
surfnames = SurfaceNames(PathToXML=path_to_xml_with_surfaces)  # -> SurfaceNames, Namespace
boundary_curve = Curve()
createsurface = CreateSurface(SurfaceNames=surfnames.SurfaceNames, Namespace=surfnames.Namespace)  # -> Surface, Breaklines

# ----
# Import all alignments from .XML file
# Import alignments
# Alignment names
path_to_xml_with_alignments = FilePath()
alignames = AlignmentNames(PathToXML=path_to_xml_with_alignments)  # -> AlignemntNames, ProfileNames, StartStationing, EndStationing, Namespace
createalignment = CreateAlignment(
    AlignemntNames=alignames.AlignemntNames,
    ProfileNames=alignames.ProfileNames,
    StartStationing=alignames.StartStationing,
    EndStationing=alignames.EndStationing,
    Namespace=alignames.Namespace)  # -> Alignment3D, AlignmentXY, Profile, StartSta, EndSta, Difference

# ----
# Import only selected alignment from .XML file
# Alignment names
# Import alignments
path_to_xml_with_alignments_2 = FilePath()
alignment_index = Slider(10, range=0..20)
alignames_2 = AlignmentNames(PathToXML=path_to_xml_with_alignments_2)  # -> AlignemntNames, ProfileNames, StartStationing, EndStationing, Namespace
path = DataPath(alignment_index)
item = ListItem(List=alignames_2.AlignemntNames, Index=alignment_index, Wrap=True)
branch = TreeBranch(Tree=alignames_2.ProfileNames, Path=path, MaintainPaths=True)
branch_2 = TreeBranch(Tree=alignames_2.StartStationing, Path=path, MaintainPaths=True)
branch_3 = TreeBranch(Tree=alignames_2.EndStationing, Path=path, MaintainPaths=True)
createalignment_2 = CreateAlignment(
    AlignemntNames=item,
    ProfileNames=branch,
    StartStationing=branch_2,
    EndStationing=branch_3,
    Namespace=alignames_2.Namespace)  # -> Alignment3D, AlignmentXY, Profile, StartSta, EndSta, Difference

# ----
# Import only selected surface from .XML file
# Import surfaces
# Surface names
path_to_xml_with_surfaces_2 = FilePath()
surface_index = Slider(10, range=0..20)
surfnames_2 = SurfaceNames(PathToXML=path_to_xml_with_surfaces_2)  # -> SurfaceNames, Namespace
boundary_curve_2 = Curve()
item_2 = ListItem(List=surfnames_2.SurfaceNames, Index=surface_index, Wrap=True)
createsurface_2 = CreateSurface(SurfaceNames=item_2, Namespace=surfnames_2.Namespace)  # -> Surface, Breaklines
